# Dynamo graph script.dyn (Dynamo 2.12.0.5650)
# packages: CircleBank_UI 0.0.1, Clockwork for Dynamo 2.x 2.3.0, GIS2BIM for Dynamo 2.x 0.11.23, Genius Loci 2022.1.5

# group: Reading JSON
readDatabase = HDLab_ZeroTouch.CircleBank.ReadDatabase()
parseJSON = Data.ParseJSON(json=readDatabase)
code_block = CodeBlock { "materialtypes"; }
valueAtKey = DesignScript.Builtin.Dictionary.ValueAtKey(dictionary=parseJSON, key=code_block)

# group: Category sorting
values = DesignScript.Builtin.Dictionary.Values(dictionary=valueAtKey)
code_block_2 = CodeBlock { "componentcategory"; }
valueAtKey_2 = DesignScript.Builtin.Dictionary.ValueAtKey(dictionary=values, key=code_block_2)
sortByKey = List.SortByKey(list=values, keys=valueAtKey_2)
groupByKey = List.GroupByKey(list=sortByKey.sortedList, keys=sortByKey.sortedKeys)

code_block_3 = CodeBlock { 1; }
flatten = List.Flatten(list=groupByKey.groups, amount=code_block_3)
code_block_4 = CodeBlock()
# ---------- code_block_4.designscript (10 lines) ----------
"title";
"componentcategory";
"length";
"width";
"height";
"totalquantity";
"quantityunit";
"interiormaterial";
"materialid";
"projectid";
# ----------------------------------------
valueAtKey_3 = DesignScript.Builtin.Dictionary.ValueAtKey(dictionary=flatten, key=code_block_4.out0)
valueAtKey_4 = DesignScript.Builtin.Dictionary.ValueAtKey(dictionary=flatten, key=code_block_4.out1)
valueAtKey_5 = DesignScript.Builtin.Dictionary.ValueAtKey(dictionary=flatten, key=code_block_4.out2)
valueAtKey_6 = DesignScript.Builtin.Dictionary.ValueAtKey(dictionary=flatten, key=code_block_4.out3)
valueAtKey_7 = DesignScript.Builtin.Dictionary.ValueAtKey(dictionary=flatten, key=code_block_4.out4)
valueAtKey_8 = DesignScript.Builtin.Dictionary.ValueAtKey(dictionary=flatten, key=code_block_4.out5)
valueAtKey_9 = DesignScript.Builtin.Dictionary.ValueAtKey(dictionary=flatten, key=code_block_4.out6)
valueAtKey_10 = DesignScript.Builtin.Dictionary.ValueAtKey(dictionary=flatten, key=code_block_4.out7)
valueAtKey_11 = DesignScript.Builtin.Dictionary.ValueAtKey(dictionary=flatten, key=code_block_4.out8)

# group: Pictures temporary
directory_path = Directory("C:\Users\LorenzoBeltrani\Box\HD Lab\02 Projekter\0137 Circle Bank [Innovation Foundation]\02 Design Tools\Revit - Dynamo\Pictures")
code_block_5 = CodeBlock { "image"; }
valueAtKey_12 = DesignScript.Builtin.Dictionary.ValueAtKey(dictionary=flatten, key=code_block_5)
code_block_6 = CodeBlock { "/"; }
split = String.Split(string=valueAtKey_12, separator0=code_block_6)
lastItem = List.LastItem(list=split@L2)
python_script = Python(IN[0]=directory_path, IN[1]=lastItem)  # IronPython2
# ---------- python_script.python (19 lines) ----------
# Load the Python Standard and DesignScript Libraries
import sys
import clr
import os
clr.AddReference('ProtoGeometry')
from Autodesk.DesignScript.Geometry import *

# The inputs to this node will be stored as a list in the IN variables.
folder = IN[0]
name = IN[1]

path = []

# Place your code below this line
for i in xrange(len(name)):
	path.append(os.path.join(folder, name[i]))

# Assign your output to the OUT variable.
OUT = path
# ----------------------------------------

valueAtKey_13 = DesignScript.Builtin.Dictionary.ValueAtKey(dictionary=flatten, key=code_block_4.out9)
code_block_7 = CodeBlock { "projects"; }
valueAtKey_14 = DesignScript.Builtin.Dictionary.ValueAtKey(dictionary=parseJSON, key=code_block_7)
values_2 = DesignScript.Builtin.Dictionary.Values(dictionary=valueAtKey_14)
valueAtKey_15 = DesignScript.Builtin.Dictionary.ValueAtKey(dictionary=values_2, key=code_block_4.out9)
code_block_8 = CodeBlock { "address"; "loc_lat"; "loc_lng"; }
valueAtKey_16 = DesignScript.Builtin.Dictionary.ValueAtKey(dictionary=values_2, key=code_block_8.out0)
valueAtKey_17 = DesignScript.Builtin.Dictionary.ValueAtKey(dictionary=values_2, key=code_block_8.out1)
valueAtKey_18 = DesignScript.Builtin.Dictionary.ValueAtKey(dictionary=values_2, key=code_block_8.out2)
python_script_2 = Python(IN[0]=valueAtKey_13, IN[1]=valueAtKey_15, IN[2]=valueAtKey_16, IN[3]=valueAtKey_17, IN[4]=valueAtKey_18)  # IronPython2
# ---------- python_script_2.python (46 lines) ----------
# Load the Python Standard and DesignScript Libraries
import sys
import clr
clr.AddReference('ProtoGeometry')
from Autodesk.DesignScript.Geometry import *

# The inputs to this node will be stored as a list in the IN variables.
itemsID = IN[0]
projectID = IN[1]
address = IN[2]
latitude = IN[3]
longitude = IN[4]

location = []
lat = []
lng = []

# Place your code below this line
for i in xrange (len(itemsID)):
	if itemsID[i] == projectID[0]:
		location.append(address[0])
		lat.append(latitude[0])
		lng.append(longitude[0])
	elif itemsID[i] == projectID[1]:
		location.append(address[1])
		lat.append(latitude[1])
		lng.append(longitude[1])
	elif itemsID[i] == projectID[2]:
		location.append(address[2])
		lat.append(latitude[2])
		lng.append(longitude[2])
	elif itemsID[i] == projectID[3]:
		location.append(address[3])
		lat.append(latitude[3])
		lng.append(longitude[3])
	elif itemsID[i] == projectID[4]:
		location.append(address[4])
		lat.append(latitude[4])
		lng.append(longitude[4])
	else:
		location.append("Unknown")
		lat.append(None)
		lng.append(None)

# Assign your output to the OUT variable.
OUT = [location, lat, lng]
# ----------------------------------------
firstItem = List.FirstItem(list=python_script_2)
GIS2BIM_GetRevitSiteLocation = Custom[GIS2BIM_GetRevitSiteLocation]()  # package GIS2BIM for Dynamo 2.x; Gets the properties of the current Site Location of the active Revit Project
toNumber = String.ToNumber(string=GIS2BIM_GetRevitSiteLocation.Lat)
toNumber_2 = String.ToNumber(string=GIS2BIM_GetRevitSiteLocation.Lon)
code_block_9 = CodeBlock { 1; 2; }
getItemAtIndex = List.GetItemAtIndex(list=python_script_2, index=code_block_9.out0)
getItemAtIndex_2 = List.GetItemAtIndex(list=python_script_2, index=code_block_9.out1)
GIS2BIM_DistanceBetweenCoordinatesWGS84 = Custom[GIS2BIM_DistanceBetweenCoordinatesWGS84](Latitude1=toNumber, Longitude1=toNumber_2, Latitude2=getItemAtIndex, Longitude2=getItemAtIndex_2)  # package GIS2BIM for Dynamo 2.x; Calculate the distance between 2 lat/lon coördinates in meters
code_block_10 = CodeBlock { 0; }
replaceNull = Custom[List.ReplaceNull](seq=GIS2BIM_DistanceBetweenCoordinatesWGS84, replacement=code_block_10)  # package Clockwork for Dynamo 2.x; Replaces all null values within a given list with a substitute
code_block_11 = CodeBlock(x=replaceNull) { Math.Round(x/1000,2); }
list_create = List.Create(item0=valueAtKey_3, item1=valueAtKey_4, item2=valueAtKey_5, item3=valueAtKey_6, item4=valueAtKey_7, item5=valueAtKey_8, item6=valueAtKey_9, item7=valueAtKey_10, item8=valueAtKey_11, item9=python_script, item10=firstItem, item11=code_block_11)
transpose = List.Transpose(lists=list_create)
code_block_12 = CodeBlock { ["","Bjælke","Gulv","Dør","Vindue","Væg"]; }
code_block_13 = CodeBlock { ["","Træ","Metal","Plast","Tegl"]; }
code_block_14 = CodeBlock { [1,20]; }
UI_PickfromDB = HDLab_ZeroTouch.CircleBank.UI_PickfromDB(DB=transpose, categories=code_block_12, materials=code_block_13, distance=code_block_14)
code_block_15 = CodeBlock { [1,2]; }
getItemAtIndex_3 = List.GetItemAtIndex(list=UI_PickfromDB, index=code_block_15)

# group: doc
python_script_3 = Python()  # IronPython2; unwired: IN[0]
# ---------- python_script_3.python (18 lines) ----------
# Load the Python Standard and DesignScript Libraries
import sys
import clr
clr.AddReference('ProtoGeometry')
from Autodesk.DesignScript.Geometry import *
clr.AddReference("RevitServices")
import RevitServices
from RevitServices.Persistence import DocumentManager

# The inputs to this node will be stored as a list in the IN variables.


# Place your code below this line
uidoc = DocumentManager.Instance.CurrentUIApplication.ActiveUIDocument
doc = uidoc.Document

# Assign your output to the OUT variable.
OUT = [uidoc,doc]
# ----------------------------------------
firstItem_2 = List.FirstItem(list=python_script_3)
lastItem_2 = List.LastItem(list=python_script_3)

python_script_4 = Python(IN[0]=getItemAtIndex_3, IN[1]=firstItem_2)  # IronPython2
# ---------- python_script_4.python (15 lines) ----------
# Load the Python Standard and DesignScript Libraries
import sys
import clr
clr.AddReference('ProtoGeometry')
from Autodesk.DesignScript.Geometry import *

# The inputs to this node will be stored as a list in the IN variables.
test = IN[0]
doc = IN[1]

# Place your code below this line
if test[0] == True and test[1] == False:
	OUT = [None, doc]
elif test[1] == True and test[0] == False:
	OUT = [doc, None]
# ----------------------------------------

# group: UI Select
firstItem_3 = List.FirstItem(list=python_script_4)
UI_Select2 = HDLab_ZeroTouch.CircleBank.UI_Select2(uidoc=firstItem_3, doc=lastItem_2)
python_script_5 = Python(IN[0]=UI_Select2)  # IronPython2
# ---------- python_script_5.python (13 lines) ----------
# Load the Python Standard and DesignScript Libraries
import sys
import clr
clr.AddReference('ProtoGeometry')
from Autodesk.DesignScript.Geometry import *

# The inputs to this node will be stored as a list in the IN variables.
element= IN[0]

# Place your code below this line

# Assign your output to the OUT variable.
OUT = element
# ----------------------------------------

# group: UI Bool
code_block_16 = CodeBlock { "The selected component is being replaced. Do you also want to replace the other components belonging to its family type?"; }
python_script_6 = Python(IN[0]=python_script_5, IN[1]=code_block_16)  # IronPython2
# ---------- python_script_6.python (15 lines) ----------
# Load the Python Standard and DesignScript Libraries
import sys
import clr
clr.AddReference('ProtoGeometry')
from Autodesk.DesignScript.Geometry import *

# The inputs to this node will be stored as a list in the IN variables.
test = IN[0]
run = IN[1]

# Place your code below this line
if test != None:
	OUT = run
else:
	OUT = []
# ----------------------------------------
UI_Bool = HDLab_ZeroTouch.CircleBank.UI_Bool(text=python_script_6)
elementType = Element.ElementType(element=python_script_5)
all_elements_of_type = Custom[All Elements of Type+](type=elementType)  # package Genius Loci; Get the instances of the given type. Works with ElementType, FamilyType, ViewFamilyType, Wall/Floor/Roof/CeilingType, GroupType, FilledRegionType and TextNoteType.
if_ = RefactoredIf(test=UI_Bool, true=all_elements_of_type, false=python_script_5)

firstItem_4 = List.FirstItem(list=UI_PickfromDB)
indexOf = List.IndexOf(list=valueAtKey_11, element=firstItem_4)
getItemAtIndex_4 = List.GetItemAtIndex(list=flatten, index=indexOf)
code_block_17 = CodeBlock { "length"; "height"; "componentcategory"; }
valueAtKey_19 = DesignScript.Builtin.Dictionary.ValueAtKey(dictionary=getItemAtIndex_4, key=code_block_17.out2)
translator = Python(IN[0]=valueAtKey_19)  # IronPython2
# ---------- translator.python (40 lines) ----------
# Load the Python Standard and DesignScript Libraries
import sys
import clr
clr.AddReference('ProtoGeometry')
from Autodesk.DesignScript.Geometry import *

# The inputs to this node will be stored as a list in the IN variables.
danish = IN[0]

# Place your code below this line
if danish == "Træ":
	english ="Wood"
elif danish == "Metal":
	english ="Metal Panel"
elif danish == "Plast":
	english = "Plastic"
elif danish == "Vindue":
	english ="Windows"
elif danish == "Bjælke":
	english = "Structural Framing"
elif danish == "Dør":
	english = "Doors"
elif danish == "Gulv":
	english = "Floors"
elif danish == "Væg":
	english = "Walls"
elif danish == "Udvendige Vinduer":
	english = "Windows"
elif danish == "Udvendige Døre":
	english = "Doors"
elif danish == "Etagedæk":
	english = "Floors"
elif danish == "Facade":
	english = "Walls"
elif danish == "Indvendige Døre":
	english = "Doors"
elif danish == "Indvendige Vægge":
	english = "Walls"
# Assign your output to the OUT variable.
OUT = english
# ----------------------------------------
python_script_7 = Python(IN[0]=getItemAtIndex_3, IN[1]=translator)  # IronPython2
# ---------- python_script_7.python (21 lines) ----------
# Load the Python Standard and DesignScript Libraries
import sys
import clr
clr.AddReference('ProtoGeometry')
from Autodesk.DesignScript.Geometry import *

# The inputs to this node will be stored as a list in the IN variables.
test = IN[0]
translator = IN[1]

run = False

# Place your code below this line
for i in xrange(len(test)):
	if test[i] == True:
		run = True
	
if run == False:
	OUT = None
else:
	OUT = translator
# ----------------------------------------

# group: Browse generic family
file_path = Filename("Generic families\HDLab_Generic_Window.rfa")
file_path_2 = Filename("Generic families\HDLab_Generic_Door.rfa")
python_script_8 = Python(IN[0]=python_script_7, IN[1]=file_path, IN[2]=file_path_2)  # IronPython2
# ---------- python_script_8.python (16 lines) ----------
# Load the Python Standard and DesignScript Libraries
import sys
import clr
clr.AddReference('ProtoGeometry')
from Autodesk.DesignScript.Geometry import *

# The inputs to this node will be stored as a list in the IN variables.
categ = IN[0]
window = IN[1]
door = IN[2]

# Place your code below this line
if categ == "Windows":
	OUT = window
elif categ == "Doors":
	OUT = door
# ----------------------------------------
loadFamily = Custom[Document.LoadFamily](path=python_script_8)  # package Clockwork for Dynamo 2.x; A very crude implementation of family loading. Will *not* reload an already loaded family of the same name.

firstItem_5 = List.FirstItem(list=loadFamily.familyTypes)
valueAtKey_20 = DesignScript.Builtin.Dictionary.ValueAtKey(dictionary=getItemAtIndex_4, key=code_block_17.out0)
code_block_18 = CodeBlock(x=valueAtKey_20) { x*10; }
valueAtKey_21 = DesignScript.Builtin.Dictionary.ValueAtKey(dictionary=getItemAtIndex_4, key=code_block_17.out1)
code_block_19 = CodeBlock(x=valueAtKey_21) { x*10; }
list_create_2 = List.Create(item0=code_block_18, item1=code_block_19)

# group: Constructing family type name
code_block_20 = CodeBlock { "HD Lab - "; }
string_from_object = FromObject(object=list_create_2)
list_create_3 = List.Create(item0=string_from_object)
code_block_21 = CodeBlock { "x"; }
join = String.Join(separator=code_block_21)  # unwired: string0
map = List.Map(list=list_create_3, function=join)
flatten_by_1 = Python(IN[0]=map)  # IronPython2
# ---------- flatten_by_1.python (13 lines) ----------
# Load the Python Standard and DesignScript Libraries
import sys
import clr
clr.AddReference('ProtoGeometry')
from Autodesk.DesignScript.Geometry import *

# The inputs to this node will be stored as a list in the IN variables.
x = IN[0]

# Place your code below this line

# Assign your output to the OUT variable.
OUT = x[0]
# ----------------------------------------
code_block_22 = CodeBlock { "mm"; }
python_script_9 = Python(IN[0]=code_block_20, IN[1]=flatten_by_1, IN[2]=code_block_22)  # IronPython2
# ---------- python_script_9.python (18 lines) ----------
# Load the Python Standard and DesignScript Libraries
import sys
import clr
clr.AddReference('ProtoGeometry')
from Autodesk.DesignScript.Geometry import *

# The inputs to this node will be stored as a list in the IN variables.
lab = IN[0]
x = IN[1]
mm = IN[2]

names = []
# Place your code below this line
for i in xrange(len(x)):
	names.append(lab+x[i]+mm)

# Assign your output to the OUT variable.
OUT = names
# ----------------------------------------

# group: Create new family type
duplicate = Custom[FamilyType.Duplicate](elementType=firstItem_5, name=python_script_9)  # package Clockwork for Dynamo 2.x; Duplicates a family type
code_block_23 = CodeBlock { "Width"; "Height"; }
setParameterByName = Element.SetParameterByName(element=duplicate, parameterName=code_block_23.out0, value=code_block_18)
setParameterByName_2 = Element.SetParameterByName(element=duplicate, parameterName=code_block_23.out1, value=code_block_19)

# group: Replace family type in current project
code_block_24 = CodeBlock { "Type"; }
setParameterByName_3 = Element.SetParameterByName(element=if_, parameterName=code_block_24, value=duplicate)

elementType_2 = Element.ElementType(element=python_script_5)
code_block_25 = CodeBlock { "CB component ID"; "CB Revit component ID"; "Original Revit component ID"; "Booked"; }
list_create_4 = List.Create(item0=code_block_25.out0, item1=code_block_25.out1, item2=code_block_25.out2, item3=code_block_25.out3)

# group: Check if the parameters already exist
parameters = Element.Parameters(element=setParameterByName)
string_from_object_2 = FromObject(object=parameters)
python_script_10 = Python(IN[0]=string_from_object_2, IN[1]=list_create_4)  # IronPython2
# ---------- python_script_10.python (18 lines) ----------
import clr
clr.AddReference('ProtoGeometry')
from Autodesk.DesignScript.Geometry import *
#The inputs to this node will be stored as a list in the IN variables.
elementParameters=IN[0]
parameters=IN[1]
x=[]

for i in xrange (0,len(elementParameters)):
	if parameters[0] in elementParameters[i] or parameters[1] in elementParameters[i] or parameters[2] in elementParameters[i]:
		x.Add(1)
	else:
		x.Add(0)

if max(x)==1:
	OUT=None
else:
	OUT=parameters
# ----------------------------------------

byName = Category.ByName(name=python_script_7)

# group: Create instance parameters
string = StringInput("Circle Bank")
select_parameter_type = ParameterType("Text")
select_parameter_type_2 = ParameterType("Integer")
select_parameter_type_3 = ParameterType("Integer")
select_parameter_type_4 = ParameterType("YesNo")
create = List.Create(item0=select_parameter_type, item1=select_parameter_type_2, item2=select_parameter_type_3, item3=select_parameter_type_4)
select_builtin_parameter_group = BuiltInParameterGroup("PG_REFERENCE")
boolean = BoolSelector(false)
createProjectParameter = Parameter.CreateProjectParameter(parameterName=python_script_10, groupName=string, type=create, group=select_builtin_parameter_group, instance=boolean, categoryList=byName)

# group: Set parameters value (Original component)
firstItem_6 = List.FirstItem(list=setParameterByName)
id = Element.Id(element=firstItem_6)
passthrough = Custom[Passthrough](passThrough=elementType_2, waitFor=createProjectParameter)  # package Clockwork for Dynamo 2.x; Forces a sequential order of execution. The node wired into the output of the Passthrough node will be executed *after* the node wired into the waitFor input (e.g. important for some Revit operations). The value of the passThrough input will be passed on to the node wired into the output port of the Passthrough node.
python_script_11 = Python(IN[0]=id, IN[1]=passthrough)  # IronPython2
# ---------- python_script_11.python (15 lines) ----------
# Load the Python Standard and DesignScript Libraries
import sys
import clr
clr.AddReference('ProtoGeometry')
from Autodesk.DesignScript.Geometry import *

# The inputs to this node will be stored as a list in the IN variables.
test = IN[0]
run = IN[1]

# Place your code below this line
if test != None:
	OUT = run
else:
	OUT = None
# ----------------------------------------
code_block_26 = CodeBlock { [0,1]; ""; }
getItemAtIndex_5 = List.GetItemAtIndex(list=list_create_4, index=code_block_26.out0)
list_create_5 = List.Create(item0=code_block_26.out1, item1=id)
setParameterByName_4 = Element.SetParameterByName(element=python_script_11, parameterName=getItemAtIndex_5, value=list_create_5)

firstItem_7 = List.FirstItem(list=duplicate)
code_block_27 = CodeBlock { [0,2,3]; }
getItemAtIndex_6 = List.GetItemAtIndex(list=list_create_4, index=code_block_27)
id_2 = Element.Id(element=elementType_2)

# group: Set parameters value (CB component)
passthrough_2 = Custom[Passthrough](passThrough=firstItem_7, waitFor=createProjectParameter)
boolean_2 = BoolSelector(false)
create_2 = List.Create(item0=firstItem_4, item1=id_2, item2=boolean_2)
setParameterByName_5 = Element.SetParameterByName(element=passthrough_2, parameterName=getItemAtIndex_6, value=create_2)

# group: Place component in the model
lastItem_3 = List.LastItem(list=python_script_4)
name = Element.Name(element=setParameterByName)
name_2 = Element.Name(element=setParameterByName_2)
list_create_6 = List.Create(item0=name, item1=name_2)
firstItem_8 = List.FirstItem(list=list_create_6)
end = Revit.Transaction.Transaction.End(input=firstItem_8)
placeInstanceHost = HDLab_ZeroTouch.CircleBank.PlaceInstanceHost(uidoc=lastItem_3, doc=lastItem_2, typeName=end)
