# Dynamo graph script.dyn (Dynamo 2.12.0.5650)
# packages: Clockwork for Dynamo 2.x 2.3.0, Genius Loci 2022.1.5

# group: Reading JSON
readDatabase = HDLab_ZeroTouch.CircleBank.ReadDatabase()
parseJSON = Data.ParseJSON(json=readDatabase)
code_block = CodeBlock { "materialtypes"; }
valueAtKey = DesignScript.Builtin.Dictionary.ValueAtKey(dictionary=parseJSON, key=code_block)

# group: Category sorting
values = DesignScript.Builtin.Dictionary.Values(dictionary=valueAtKey)
code_block_2 = CodeBlock { "componentcategory"; }
valueAtKey_2 = DesignScript.Builtin.Dictionary.ValueAtKey(dictionary=values, key=code_block_2)
sortByKey = List.SortByKey(list=values, keys=valueAtKey_2)
groupByKey = List.GroupByKey(list=sortByKey.sortedList, keys=sortByKey.sortedKeys)

# group: UI Selection
python_script = Python()  # IronPython2; unwired: IN[0]
# ---------- python_script.python (18 lines) ----------
# Load the Python Standard and DesignScript Libraries
import sys
import clr
clr.AddReference('ProtoGeometry')
from Autodesk.DesignScript.Geometry import *
clr.AddReference("RevitServices")
import RevitServices
from RevitServices.Persistence import DocumentManager

# The inputs to this node will be stored as a list in the IN variables.


# Place your code below this line
uidoc = DocumentManager.Instance.CurrentUIApplication.ActiveUIDocument
doc = uidoc.Document

# Assign your output to the OUT variable.
OUT = [uidoc,doc]
# ----------------------------------------
firstItem = List.FirstItem(list=python_script)
lastItem = List.LastItem(list=python_script)
UI_Select4 = HDLab_ZeroTouch.CircleBank.UI_Select4(uidoc=firstItem, doc=lastItem)
python_script_2 = Python(IN[0]=UI_Select4)  # IronPython2
# ---------- python_script_2.python (13 lines) ----------
# Load the Python Standard and DesignScript Libraries
import sys
import clr
clr.AddReference('ProtoGeometry')
from Autodesk.DesignScript.Geometry import *

# The inputs to this node will be stored as a list in the IN variables.
element= IN[0]

# Place your code below this line

# Assign your output to the OUT variable.
OUT = element
# ----------------------------------------
elementType = Element.ElementType(element=python_script_2)
getCategory = Element.GetCategory(element=elementType)
name = Category.Name(category=getCategory)
all_elements_of_type = Custom[All Elements of Type+](type=elementType)  # package Genius Loci; Get the instances of the given type. Works with ElementType, FamilyType, ViewFamilyType, Wall/Floor/Roof/CeilingType, GroupType, FilledRegionType and TextNoteType.
count = List.Count(list=all_elements_of_type)
python_script_3 = Python(IN[0]=all_elements_of_type, IN[1]=count)  # IronPython2
# ---------- python_script_3.python (17 lines) ----------
# Load the Python Standard and DesignScript Libraries
import sys
import clr
clr.AddReference('ProtoGeometry')
from Autodesk.DesignScript.Geometry import *

# The inputs to this node will be stored as a list in the IN variables.
list_ = IN[0]
count = IN[1]
list = []

# Place your code below this line
if count>1:
	OUT=list_
else:
	list.append(list_)
	OUT = list
# ----------------------------------------
select_in_revit = Python(IN[0]=python_script_3)  # IronPython2
# ---------- select_in_revit.python (28 lines) ----------
import clr

clr.AddReference("RevitNodes")
import Revit
clr.ImportExtensions(Revit.Elements)

clr.AddReference("RevitServices")
import RevitServices
from RevitServices.Persistence import DocumentManager
from System.Collections.Generic import *

# Import RevitAPI
clr.AddReference("RevitAPI")
import Autodesk
from Autodesk.Revit.DB import *

doc = DocumentManager.Instance.CurrentDBDocument
uidoc = DocumentManager.Instance.CurrentUIApplication.ActiveUIDocument

element = UnwrapElement(IN[0])

elementIdList = List[ElementId]()
for i in xrange(len(IN[0])):
	elementIdList.Add(element[i].Id)

sel = uidoc.Selection.SetElementIds(elementIdList)

OUT = True
# ----------------------------------------

# group: Deal with bad naming
translator = Python(IN[0]=groupByKey.uniqueKeys)  # IronPython2
# ---------- translator.python (50 lines) ----------
# Load the Python Standard and DesignScript Libraries
import sys
import clr
clr.AddReference('ProtoGeometry')
from Autodesk.DesignScript.Geometry import *

# The inputs to this node will be stored as a list in the IN variables.
danish = IN[0]
english=[]

# Place your code below this line
for i in xrange (len(danish)):
	if danish[i] == "Træ":
		english.append("Wood")
	elif danish[i] == "Metal":
		english.append("Metal Panel")
	elif danish[i] == "Plast":
		english.append("Plastic")
	elif danish[i] == "Vindue":
		english.append("Windows")
	elif danish[i] == "Bjælke":
		english.append("Structural Framing")
	elif danish[i] == "Dør":
		english.append("Doors")
	elif danish[i] == "Gulv":
		english.append("Floors")
	elif danish[i] == "Væg":
		english.append("Walls")
	elif danish[i] == "Udvendige Vinduer":
		english.append("Windows")
	elif danish[i] == "Udvendige Døre":
		english.append("Doors")
	elif danish[i] == "Etagedæk":
		english.append("Floors")
	elif danish[i] == "Facade":
		english.append("Walls")
	elif danish[i] == "Indvendige Døre":
		english.append("Doors")
	elif danish[i] == "Indvendige Vægge":
		english.append("Walls")
	elif danish[i] == "Loft":
		english.append("Ceilings")
	elif danish[i] == "Ydervæg":
		english.append("Walls")
	elif danish[i] == "Exterior Door":
		english.append("Doors")
	elif danish[i] == "Tag":
		english.append("Roofs")
# Assign your output to the OUT variable.
OUT = english
# ----------------------------------------
groupByKey_2 = List.GroupByKey(list=groupByKey.groups, keys=translator)
indexOf = List.IndexOf(list=groupByKey_2.uniqueKeys, element=name)
getItemAtIndex = List.GetItemAtIndex(list=groupByKey_2.groups, index=indexOf)
flatten = List.Flatten(list=getItemAtIndex)
getItemAtIndex_2 = List.GetItemAtIndex(list=groupByKey_2.uniqueKeys, index=indexOf)

# group: Report
name_2 = Element.Name(element=elementType)
python_script_4 = Python(IN[0]=count, IN[1]=name_2, IN[2]=name)  # IronPython2
# ---------- python_script_4.python (17 lines) ----------
# Load the Python Standard and DesignScript Libraries
import sys
import clr
clr.AddReference('ProtoGeometry')
from Autodesk.DesignScript.Geometry import *

# The inputs to this node will be stored as a list in the IN variables.
count = IN[0]
type = IN[1]
categ = IN[2]

# Place your code below this line
if count >1:
	OUT = str(count) + " elements of " + type + " type, belonging to " + categ + " category, have been found and selected in the model"
else:
	OUT = str(count) + " element of " + type + " type, belonging to " + categ + " category, has been found and selected in the model"
# Assign your output to the OUT variable.
# ----------------------------------------

# group: Requirements
python_script_5 = Python(IN[0]=python_script_4, IN[1]=select_in_revit)  # IronPython2
# ---------- python_script_5.python (13 lines) ----------
# Load the Python Standard and DesignScript Libraries
import sys
import clr
clr.AddReference('ProtoGeometry')
from Autodesk.DesignScript.Geometry import *

# The inputs to this node will be stored as a list in the IN variables.
run = IN[0]
bool = IN[1]

# Place your code below this line
if bool == True:
	OUT = run
# ----------------------------------------
number_slider = DoubleSlider(1000, range=100..5000 step 1)
number_slider_2 = DoubleSlider(2500, range=100..5000 step 1)
UI_Requirements2 = HDLab_ZeroTouch.CircleBank.UI_Requirements2(text=python_script_5, minPrice=number_slider, maxPrice=number_slider_2)

code_block_3 = CodeBlock { 1; }
getItemAtIndex_3 = List.GetItemAtIndex(list=UI_Requirements2, index=code_block_3)

# group: Size
code_block_4 = CodeBlock { "length"; "height"; "width"; }
valueAtKey_3 = DesignScript.Builtin.Dictionary.ValueAtKey(dictionary=flatten, key=code_block_4.out0)
valueAtKey_4 = DesignScript.Builtin.Dictionary.ValueAtKey(dictionary=flatten, key=code_block_4.out1)
valueAtKey_5 = DesignScript.Builtin.Dictionary.ValueAtKey(dictionary=flatten, key=code_block_4.out2)
code_block_5 = CodeBlock(x=valueAtKey_3, y=valueAtKey_4, z=valueAtKey_5) { x*10; y*10; z*10; }

firstItem_2 = List.FirstItem(list=UI_Requirements2)
toNumber = String.ToNumber(string=firstItem_2)

# group: Comparison
list_create = List.Create(item0=code_block_5.out0, item1=code_block_5.out1)
transpose = List.Transpose(lists=list_create)
firstItem_3 = List.FirstItem(list=transpose@L2)
code_block_6 = CodeBlock { "Height"; "Width"; }
getParameterValueByName = Element.GetParameterValueByName(element=elementType, parameterName=code_block_6.out1)
sub = firstItem_3 - getParameterValueByName  # lacing=CrossProduct
abs = Math.Abs(number=sub)
lt = abs < toNumber
lastItem_2 = List.LastItem(list=transpose@L2)
getParameterValueByName_2 = Element.GetParameterValueByName(element=elementType, parameterName=code_block_6.out0)
sub_2 = lastItem_2 - getParameterValueByName_2  # lacing=CrossProduct
abs_2 = Math.Abs(number=sub_2)
lt_2 = abs_2 < toNumber
and_ = lt && lt_2

# group: Material
code_block_7 = CodeBlock { "interiormaterial"; }
valueAtKey_6 = DesignScript.Builtin.Dictionary.ValueAtKey(dictionary=flatten, key=code_block_7)
translator_2 = Python(IN[0]=valueAtKey_6)  # IronPython2
# ---------- translator_2.python (28 lines) ----------
# Load the Python Standard and DesignScript Libraries
import sys
import clr
clr.AddReference('ProtoGeometry')
from Autodesk.DesignScript.Geometry import *

# The inputs to this node will be stored as a list in the IN variables.
danish = IN[0]
english=[]

# Place your code below this line
for i in xrange (len(danish)):
	if danish[i] == "Træ":
		english.append("Wood")
	elif danish[i] == "Metal":
		english.append("Metal Panel")
	elif danish[i] == "Plast":
		english.append("Plastic")
	elif danish[i] == "Vindue":
		english.append("Windows")
	elif danish[i] == "Trævindue":
		english.append("Wood")
	elif danish[i] == "Energirude 4mm glas":
		english.append("Glass")
	elif danish[i] == "Aluminium solafskærmning":
		english.append("Aluminium")
# Assign your output to the OUT variable.
OUT = english
# ----------------------------------------
byName = Material.ByName(name=translator_2)
getMaterials = Element.GetMaterials(element=elementType)
lastItem_3 = List.LastItem(list=getMaterials)

eq = byName == lastItem_3
material_match = and_ && eq
if_ = RefactoredIf(test=getItemAtIndex_3, true=material_match, false=and_)

# group (continued): Comparison
python_script_6 = Python(IN[0]=if_)  # IronPython2
# ---------- python_script_6.python (17 lines) ----------
# Load the Python Standard and DesignScript Libraries
import sys
import clr
clr.AddReference('ProtoGeometry')
from Autodesk.DesignScript.Geometry import *

# The inputs to this node will be stored as a list in the IN variables.
bool = IN[0]
trues = []

# Place your code below this line
for i in xrange(len(bool)):
	if bool[i] == True:
		trues.append(i)

# Assign your output to the OUT variable.
OUT = trues
# ----------------------------------------

# group: Matching
getItemAtIndex_4 = List.GetItemAtIndex(list=flatten, index=python_script_6)
identity = Object.Identity()  # unwired: object
groupByFunction = List.GroupByFunction(list=python_script_6, groupFunction=identity)
code_block_8 = CodeBlock { "totalquantity"; }
count_2 = List.Count(list=all_elements_of_type)
python_script_7 = Python(IN[0]=all_elements_of_type, IN[1]=count_2)  # IronPython2
# ---------- python_script_7.python (15 lines) ----------
# Load the Python Standard and DesignScript Libraries
import sys
import clr
clr.AddReference('ProtoGeometry')
from Autodesk.DesignScript.Geometry import *

# The inputs to this node will be stored as a list in the IN variables.
el = IN[0]
count = IN[1]

# Place your code below this line
if count == 1:
	OUT = [el]
else:
	OUT = el
# ----------------------------------------

flatten_2 = List.Flatten(list=groupByFunction)

# group (continued): Matching
groupByKey_3 = List.GroupByKey(list=getItemAtIndex_4, keys=flatten_2@L2)
firstItem_4 = List.FirstItem(list=groupByKey_3.groups@L2)
valueAtKey_7 = DesignScript.Builtin.Dictionary.ValueAtKey(dictionary=firstItem_4, key=code_block_8)
python_script_8 = Python(IN[0]=valueAtKey_7, IN[1]=python_script_7, IN[2]=firstItem_4)  # IronPython2
# ---------- python_script_8.python (24 lines) ----------
# Load the Python Standard and DesignScript Libraries
import sys
import clr
clr.AddReference('ProtoGeometry')
from Autodesk.DesignScript.Geometry import *

# The inputs to this node will be stored as a list in the IN variables.
poolCount = IN[0]
components = IN[1]
poolComponent = IN[2]

exchange = []

# Place your code below this line
for i in xrange(len(poolCount)):
	for j in xrange(len(components)):
		if poolCount[i] >= 0:
			exchange.append([components[j],poolComponent[i]])
			poolCount[i] -= 1
		else:
			break

# Assign your output to the OUT variable.
OUT = [exchange,poolCount]
# ----------------------------------------
remaining_in_the_db = List.LastItem(list=python_script_8)
match = List.FirstItem(list=python_script_8)

# group: Browse generic family
file_path = Filename("Generic families\HDLab_Generic_Window.rfa")
file_path_2 = Filename("Generic families\HDLab_Generic_Door.rfa")
python_script_9 = Python(IN[0]=name, IN[1]=file_path, IN[2]=file_path_2)  # IronPython2
# ---------- python_script_9.python (16 lines) ----------
# Load the Python Standard and DesignScript Libraries
import sys
import clr
clr.AddReference('ProtoGeometry')
from Autodesk.DesignScript.Geometry import *

# The inputs to this node will be stored as a list in the IN variables.
categ = IN[0]
window = IN[1]
door = IN[2]

# Place your code below this line
if categ == "Windows":
	OUT = window
elif categ == "Doors":
	OUT = door
# ----------------------------------------
loadFamily = Custom[Document.LoadFamily](path=python_script_9)  # package Clockwork for Dynamo 2.x; A very crude implementation of family loading. Will *not* reload an already loaded family of the same name.

code_block_9 = CodeBlock { "quality"; "gwpnew"; "gwpreused"; "costnew"; "costreused"; }
valueAtKey_8 = DesignScript.Builtin.Dictionary.ValueAtKey(dictionary=firstItem_4, key=code_block_9.out3)
valueAtKey_9 = DesignScript.Builtin.Dictionary.ValueAtKey(dictionary=firstItem_4, key=code_block_9.out1)

# group: Max size difference
getItemAtIndex_5 = List.GetItemAtIndex(list=abs, index=python_script_6)
getItemAtIndex_6 = List.GetItemAtIndex(list=abs_2, index=python_script_6)
max = Math.Max(value1=getItemAtIndex_5, value2=getItemAtIndex_6)

valueAtKey_10 = DesignScript.Builtin.Dictionary.ValueAtKey(dictionary=firstItem_4, key=code_block_9.out0)
valueAtKey_11 = DesignScript.Builtin.Dictionary.ValueAtKey(dictionary=firstItem_4, key=code_block_9.out2)
valueAtKey_12 = DesignScript.Builtin.Dictionary.ValueAtKey(dictionary=firstItem_4, key=code_block_9.out4)

# group: UI sorting matching components and pick selected
code_block_10 = CodeBlock { "title"; "interiormaterial"; "materialid"; }
valueAtKey_13 = DesignScript.Builtin.Dictionary.ValueAtKey(dictionary=firstItem_4, key=code_block_10.out0)
valueAtKey_14 = DesignScript.Builtin.Dictionary.ValueAtKey(dictionary=firstItem_4, key=code_block_10.out1)
valueAtKey_15 = DesignScript.Builtin.Dictionary.ValueAtKey(dictionary=firstItem_4, key=code_block_10.out2)
# note: Items left in the Database after been used in the current project
list_create_2 = List.Create(item0=valueAtKey_13, item1=max, item2=valueAtKey_14, item3=valueAtKey_10, item4=valueAtKey_15, item5=valueAtKey_11, item6=valueAtKey_12)
transpose_2 = List.Transpose(lists=list_create_2)
python_script_10 = Python(IN[0]=python_script_6, IN[1]=transpose_2)  # IronPython2
# ---------- python_script_10.python (15 lines) ----------
# Load the Python Standard and DesignScript Libraries
import sys
import clr
clr.AddReference('ProtoGeometry')
from Autodesk.DesignScript.Geometry import *

# The inputs to this node will be stored as a list in the IN variables.
x = IN[0]
y= IN[1]

# Place your code below this line
if len(x) == 0:
	OUT = None
else:
	OUT = y
# ----------------------------------------

addItemToEnd = List.AddItemToEnd(item=valueAtKey_9@L1, list=python_script_10@L2)
addItemToEnd_2 = List.AddItemToEnd(item=valueAtKey_8@L1, list=addItemToEnd@L2)

# group (continued): UI sorting matching components and pick selected
UI_SortList_LCA = HDLab_ZeroTouch.CircleBank.UI_SortList_LCA(DB=addItemToEnd_2)

# group: Index of selected
code_block_11 = CodeBlock { "materialid"; }
valueAtKey_16 = DesignScript.Builtin.Dictionary.ValueAtKey(dictionary=flatten, key=code_block_11)
firstItem_5 = List.FirstItem(list=UI_SortList_LCA)
indexOf_2 = List.IndexOf(list=valueAtKey_16, element=firstItem_5)

getItemAtIndex_7 = List.GetItemAtIndex(list=transpose, index=indexOf_2)

# group: Constructing family type name
code_block_12 = CodeBlock { "HD Lab - "; }
string_from_object = FromObject(object=getItemAtIndex_7)
list_create_3 = List.Create(item0=string_from_object)
code_block_13 = CodeBlock { "x"; }
join = String.Join(separator=code_block_13)  # unwired: string0
map = List.Map(list=list_create_3, function=join)
flatten_by_1 = Python(IN[0]=map)  # IronPython2
# ---------- flatten_by_1.python (13 lines) ----------
# Load the Python Standard and DesignScript Libraries
import sys
import clr
clr.AddReference('ProtoGeometry')
from Autodesk.DesignScript.Geometry import *

# The inputs to this node will be stored as a list in the IN variables.
x = IN[0]

# Place your code below this line

# Assign your output to the OUT variable.
OUT = x[0]
# ----------------------------------------
code_block_14 = CodeBlock { "mm"; }
python_script_11 = Python(IN[0]=code_block_12, IN[1]=flatten_by_1, IN[2]=code_block_14)  # IronPython2
# ---------- python_script_11.python (18 lines) ----------
# Load the Python Standard and DesignScript Libraries
import sys
import clr
clr.AddReference('ProtoGeometry')
from Autodesk.DesignScript.Geometry import *

# The inputs to this node will be stored as a list in the IN variables.
lab = IN[0]
x = IN[1]
mm = IN[2]

names = []
# Place your code below this line
for i in xrange(len(x)):
	names.append(lab+x[i]+mm)

# Assign your output to the OUT variable.
OUT = names
# ----------------------------------------

python_script_12 = Python(IN[0]=python_script_11, IN[1]=indexOf_2)  # IronPython2
# ---------- python_script_12.python (13 lines) ----------
# Load the Python Standard and DesignScript Libraries
import sys
import clr
clr.AddReference('ProtoGeometry')
from Autodesk.DesignScript.Geometry import *

# The inputs to this node will be stored as a list in the IN variables.
input = IN[0]
run = IN[1]

# Place your code below this line
if run != -1:
	OUT = input
# ----------------------------------------

# group: Create new family type
duplicate = Custom[FamilyType.Duplicate](elementType=loadFamily.familyTypes, name=python_script_12)  # package Clockwork for Dynamo 2.x; Duplicates a family type
code_block_15 = CodeBlock { "Width"; "Height"; }
firstItem_6 = List.FirstItem(list=getItemAtIndex_7@L2)
setParameterByName = Element.SetParameterByName(element=duplicate, parameterName=code_block_15.out0, value=firstItem_6)
lastItem_4 = List.LastItem(list=getItemAtIndex_7@L2)
setParameterByName_2 = Element.SetParameterByName(element=duplicate, parameterName=code_block_15.out1, value=lastItem_4)

firstItem_7 = List.FirstItem(list=match@L2)

# group: Selected or all elements of type
list_create_4 = List.Create(item0=python_script_2)
list_create_5 = List.Create(item0=list_create_4, item1=firstItem_7)
code_block_16 = CodeBlock { "The selected component is being replaced. Do you also want to replace the other components belonging to its family type?"; }
isEmpty = List.IsEmpty(list=match)
count_3 = List.Count(list=firstItem_7)
python_script_13 = Python(IN[0]=code_block_16, IN[1]=isEmpty, IN[2]=count_3)  # IronPython2
# ---------- python_script_13.python (16 lines) ----------
# Load the Python Standard and DesignScript Libraries
import sys
import clr
clr.AddReference('ProtoGeometry')
from Autodesk.DesignScript.Geometry import *

# The inputs to this node will be stored as a list in the IN variables.
output = IN[0]
bool = IN[1]
count = IN[2]

# Place your code below this line
if bool == True or count == 1:
	OUT=0
else:
	OUT=output
# ----------------------------------------
passthrough = Custom[Passthrough](passThrough=python_script_13, waitFor=UI_SortList_LCA)  # package Clockwork for Dynamo 2.x; Forces a sequential order of execution. The node wired into the output of the Passthrough node will be executed *after* the node wired into the waitFor input (e.g. important for some Revit operations). The value of the passThrough input will be passed on to the node wired into the output port of the Passthrough node.
UI_Bool = HDLab_ZeroTouch.CircleBank.UI_Bool(text=passthrough)
python_script_14 = Python(IN[0]=list_create_5, IN[1]=UI_Bool)  # IronPython2
# ---------- python_script_14.python (15 lines) ----------
# Load the Python Standard and DesignScript Libraries
import sys
import clr
clr.AddReference('ProtoGeometry')
from Autodesk.DesignScript.Geometry import *

# The inputs to this node will be stored as a list in the IN variables.
output = IN[0]
bool = IN[1]

# Place your code below this line
if bool == True:
	OUT=output[1]
else:
	OUT=output[0]
# ----------------------------------------

# group: Replace family type in current project
# note: When the user decides to use the DB componets, the quantity shold be updated in the JSON
list_create_6 = List.Create(item0=python_script_14)
code_block_17 = CodeBlock { "Type"; }
setParameterByName_3 = Element.SetParameterByName(element=list_create_6, parameterName=code_block_17, value=duplicate)

firstItem_8 = List.FirstItem(list=duplicate)
code_block_18 = CodeBlock { "CB component ID"; "CB Revit component ID"; "Original Revit component ID"; "Booked"; }
list_create_7 = List.Create(item0=code_block_18.out0, item1=code_block_18.out1, item2=code_block_18.out2, item3=code_block_18.out3)

# group: Check if the parameters already exist
parameters = Element.Parameters(element=elementType)
string_from_object_2 = FromObject(object=parameters)
python_script_15 = Python(IN[0]=string_from_object_2, IN[1]=list_create_7)  # IronPython2
# ---------- python_script_15.python (18 lines) ----------
import clr
clr.AddReference('ProtoGeometry')
from Autodesk.DesignScript.Geometry import *
#The inputs to this node will be stored as a list in the IN variables.
elementParameters=IN[0]
parameters=IN[1]
x=[]

for i in xrange (0,len(elementParameters)):
	if parameters[0] in elementParameters[i] or parameters[1] in elementParameters[i] or parameters[2] in elementParameters[i]:
		x.Add(1)
	else:
		x.Add(0)

if max(x)==1:
	OUT=None
else:
	OUT=parameters
# ----------------------------------------

# group: Create instance parameters
string = StringInput("Circle Bank")
select_parameter_type = ParameterType("Text")
select_parameter_type_2 = ParameterType("Integer")
select_parameter_type_3 = ParameterType("Integer")
select_parameter_type_4 = ParameterType("YesNo")
create = List.Create(item0=select_parameter_type, item1=select_parameter_type_2, item2=select_parameter_type_3, item3=select_parameter_type_4)
select_builtin_parameter_group = BuiltInParameterGroup("PG_REFERENCE")
boolean = BoolSelector(false)
createProjectParameter = Parameter.CreateProjectParameter(parameterName=python_script_15, groupName=string, type=create, group=select_builtin_parameter_group, instance=boolean, categoryList=getCategory)

code_block_19 = CodeBlock { [0,2,3]; }
getItemAtIndex_8 = List.GetItemAtIndex(list=list_create_7, index=code_block_19)
toNumber_2 = String.ToNumber(string=firstItem_5)
floor = Math.Floor(number=toNumber_2)
string_from_object_3 = FromObject(object=floor)
id = Element.Id(element=elementType)

# group: Set parameters value (CB component)
passthrough_2 = Custom[Passthrough](passThrough=firstItem_8, waitFor=createProjectParameter)
boolean_2 = BoolSelector(false)
create_2 = List.Create(item0=string_from_object_3, item1=id, item2=boolean_2)
setParameterByName_4 = Element.SetParameterByName(element=passthrough_2, parameterName=getItemAtIndex_8, value=create_2)

# group: Set parameters value (Original component)
firstItem_9 = List.FirstItem(list=duplicate)
id_2 = Element.Id(element=firstItem_9)
passthrough_3 = Custom[Passthrough](passThrough=elementType, waitFor=createProjectParameter)
python_script_16 = Python(IN[0]=id_2, IN[1]=passthrough_3)  # IronPython2
# ---------- python_script_16.python (15 lines) ----------
# Load the Python Standard and DesignScript Libraries
import sys
import clr
clr.AddReference('ProtoGeometry')
from Autodesk.DesignScript.Geometry import *

# The inputs to this node will be stored as a list in the IN variables.
test = IN[0]
run = IN[1]

# Place your code below this line
if test != None:
	OUT = run
else:
	OUT = None
# ----------------------------------------
code_block_20 = CodeBlock { [0,1]; ""; }
getItemAtIndex_9 = List.GetItemAtIndex(list=list_create_7, index=code_block_20.out0)
list_create_8 = List.Create(item0=code_block_20.out1, item1=id_2)
setParameterByName_5 = Element.SetParameterByName(element=python_script_16, parameterName=getItemAtIndex_9, value=list_create_8)

# group: UI report
code_block_21 = CodeBlock { "No matches found with set requirements."; }
python_script_17 = Python(IN[0]=python_script_6, IN[1]=code_block_21, IN[2]=UI_Requirements2)  # IronPython2
# ---------- python_script_17.python (16 lines) ----------
# Load the Python Standard and DesignScript Libraries
import sys
import clr
clr.AddReference('ProtoGeometry')
from Autodesk.DesignScript.Geometry import *

# The inputs to this node will be stored as a list in the IN variables.
x = IN[0]
y= IN[1]
cancel= IN[2]

# Place your code below this line
if len(x) == 0 and cancel!=None:
	OUT = y
else:
	OUT = 0
# ----------------------------------------
UI_Report = HDLab_ZeroTouch.CircleBank.UI_Report(text=python_script_17)

count_4 = List.Count(list=python_script_12)

# group: UI report
count_5 = List.Count(list=python_script_14)
lastItem_5 = List.LastItem(list=UI_SortList_LCA)
python_script_18 = Python(IN[0]=name, IN[1]=count_5, IN[2]=lastItem_5)  # IronPython2
# ---------- python_script_18.python (22 lines) ----------
# Load the Python Standard and DesignScript Libraries
import sys
import clr
clr.AddReference('ProtoGeometry')
from Autodesk.DesignScript.Geometry import *

# The inputs to this node will be stored as a list in the IN variables.
category = IN[0]
count = IN[1]
booked = IN[2]

# Place your code below this line
if count > 1:
	if booked == True:
		OUT = str(count) + " components belonging to " + category + " category have been replaced and reserved on Circle bank database."
	else:
		OUT = str(count) + " components belonging to " + category + " category have been replaced in the model."
else:
	if booked == True:
		OUT = str(count) + " component belonging to " + category + " category has been replaced and reserved on Circle bank database."
	else:
		OUT = str(count) + " component belonging to " + category + " category has been replaced in the model."
# ----------------------------------------
python_script_19 = Python(IN[0]=count_4, IN[1]=python_script_18)  # IronPython2
# ---------- python_script_19.python (15 lines) ----------
# Load the Python Standard and DesignScript Libraries
import sys
import clr
clr.AddReference('ProtoGeometry')
from Autodesk.DesignScript.Geometry import *

# The inputs to this node will be stored as a list in the IN variables.
x = IN[0]
y= IN[1]

# Place your code below this line
if x == None:
	OUT = 0
else:
	OUT = y
# ----------------------------------------
UI_Report_2 = HDLab_ZeroTouch.CircleBank.UI_Report(text=python_script_19)
