# Dynamo graph script.dyn (Dynamo 2.12.0.5650)
# packages: Clockwork for Dynamo 2.x 2.3.0, Genius Loci 2022.1.5

all_elements_in_active_view = ElementsInView()
getCategory = Element.GetCategory(element=all_elements_in_active_view)
groupByKey = List.GroupByKey(list=all_elements_in_active_view, keys=getCategory)
categories = Categories("OST_Walls")
indexOf = List.IndexOf(list=groupByKey.uniqueKeys, element=categories)
getItemAtIndex = List.GetItemAtIndex(list=groupByKey.groups, index=indexOf)
elementType = Element.ElementType(element=getItemAtIndex)
uniqueItems = List.UniqueItems(list=elementType)
code_block = CodeBlock { "LCA"; "LCA index"; }
list_create = List.Create(item0=code_block.out0, item1=code_block.out1)

# group: Check if the parameters already exist
parameters = Element.Parameters(element=uniqueItems)

name = Parameter.Name(parameter=parameters)
firstItem = List.FirstItem(list=name)

# group (continued): Check if the parameters already exist
string_from_object = FromObject(object=firstItem)
python_script = Python(IN[0]=string_from_object, IN[1]=list_create)  # IronPython2
# ---------- python_script.python (12 lines) ----------
import clr
clr.AddReference('ProtoGeometry')
from Autodesk.DesignScript.Geometry import *
#The inputs to this node will be stored as a list in the IN variables.
elementParameters=IN[0]
parameters=IN[1]
x=[]

if parameters[0] in elementParameters or parameters[1] in elementParameters:
	OUT = None
else:
	OUT = parameters
# ----------------------------------------

# group: Create instance parameters
string = StringInput("LCA")
select_parameter_type = ParameterType("Text")
select_parameter_type_2 = ParameterType("Text")
create = List.Create(item0=select_parameter_type, item1=select_parameter_type_2)
select_builtin_parameter_group = BuiltInParameterGroup("PG_GREEN_BUILDING")
boolean = BoolSelector(false)
createProjectParameter = Parameter.CreateProjectParameter(parameterName=python_script, groupName=string, type=create, group=select_builtin_parameter_group, instance=boolean, categoryList=categories)

code_block_2 = CodeBlock { ", "; }
file_path = Filename("..\..\05 Databases\LCA\05 LCA for Revit Extension\RevitExtensionLCAData11-04-2022.xlsx")
file_from_path = FileObject(path=file_path)
code_block_3 = CodeBlock { "Results for Lorenzo"; }
boolean_2 = BoolSelector(false)
importExcel = Data.ImportExcel(file=file_from_path, sheetName=code_block_3, showExcel=boolean_2)
firstItem_2 = List.FirstItem(list=importExcel@L2)
code_block_4 = CodeBlock { "Konstruktion"; }
eq = firstItem_2 == code_block_4
filterByBoolMask = List.FilterByBoolMask(list=importExcel, mask=eq)
code_block_5 = CodeBlock { 1; }
getItemAtIndex_2 = List.GetItemAtIndex(list=filterByBoolMask.in@L2, index=code_block_5)
python_script_2 = Python(IN[0]=getItemAtIndex_2)  # IronPython2
# ---------- python_script_2.python (15 lines) ----------
# Load the Python Standard and DesignScript Libraries
import sys
import clr
clr.AddReference('ProtoGeometry')
from Autodesk.DesignScript.Geometry import *

# The inputs to this node will be stored as a list in the IN variables.
list = IN[0]

OUT=[]

# Place your code below this line
for i in xrange (len(list)):
	if "væg" in list[i]:
		OUT.append(i)
# ----------------------------------------
getItemAtIndex_3 = List.GetItemAtIndex(list=filterByBoolMask.in, index=python_script_2)
code_block_6 = CodeBlock { 2; }
getItemAtIndex_4 = List.GetItemAtIndex(list=getItemAtIndex_3@L2, index=code_block_6)
name_2 = Element.Name(element=uniqueItems)
count = List.Count(list=name_2)
ofRepeatedItem = List.OfRepeatedItem(item=getItemAtIndex_4, amount=count)
end = Revit.Transaction.Transaction.End(input=name_2)
parameterByName = Parameter.ParameterByName(element=uniqueItems, name=code_block.out0)
value = Parameter.Value(parameter=parameterByName)
python_script_3 = Python(IN[0]=value)  # IronPython2
# ---------- python_script_3.python (16 lines) ----------
# Load the Python Standard and DesignScript Libraries
import sys
import clr
clr.AddReference('ProtoGeometry')
from Autodesk.DesignScript.Geometry import *

# The inputs to this node will be stored as a list in the IN variables.
input = IN[0]
OUT=[]

# Place your code below this line
for i in xrange (len(input)):
	if input[i] == None:
		OUT.append("")
	else:
		OUT.append(input[i])
# ----------------------------------------
parameterByName_2 = Parameter.ParameterByName(element=uniqueItems, name=code_block.out1)
value_2 = Parameter.Value(parameter=parameterByName_2)
python_script_4 = Python(IN[0]=value_2)  # IronPython2
# ---------- python_script_4.python (16 lines) ----------
# Load the Python Standard and DesignScript Libraries
import sys
import clr
clr.AddReference('ProtoGeometry')
from Autodesk.DesignScript.Geometry import *

# The inputs to this node will be stored as a list in the IN variables.
input = IN[0]
OUT=[]

# Place your code below this line
for i in xrange (len(input)):
	if input[i] == None:
		OUT.append([])
	else:
		OUT.append(input[i])
# ----------------------------------------
split = String.Split(string=python_script_4, separator0=code_block_2)
toNumber = String.ToNumber(string=split)
count_2 = List.Count(list=ofRepeatedItem@L2)
python_script_5 = Python(IN[0]=toNumber, IN[1]=count_2)  # IronPython2
# ---------- python_script_5.python (20 lines) ----------
# Load the Python Standard and DesignScript Libraries
import sys
import clr
clr.AddReference('ProtoGeometry')
from Autodesk.DesignScript.Geometry import *

# The inputs to this node will be stored as a list in the IN variables.
index = IN[0]
count= IN[1]

OUT=[]

# Place your code below this line
for i in xrange (len(count)):
	OUT.append([])
	for j in xrange(0,count[i]):
		if j in index[i]:
			OUT[i].append(True)
		else:
			OUT[i].append(False)
# ----------------------------------------
anyTrue = List.AnyTrue(list=python_script_5@L2)

# group: doc / uidoc
python_script_6 = Python()  # IronPython2; unwired: IN[0]
# ---------- python_script_6.python (18 lines) ----------
# Load the Python Standard and DesignScript Libraries
import sys
import clr
clr.AddReference('ProtoGeometry')
from Autodesk.DesignScript.Geometry import *
clr.AddReference("RevitServices")
import RevitServices
from RevitServices.Persistence import DocumentManager

# The inputs to this node will be stored as a list in the IN variables.


# Place your code below this line
uidoc = DocumentManager.Instance.CurrentUIApplication.ActiveUIDocument
doc = uidoc.Document

# Assign your output to the OUT variable.
OUT = [uidoc,doc]
# ----------------------------------------
lastItem = List.LastItem(list=python_script_6)
firstItem_3 = List.FirstItem(list=python_script_6)

id = Element.Id(element=all_elements_in_active_view)
all_elements_of_type = Custom[All Elements of Type+](type=uniqueItems)  # package Genius Loci; Get the instances of the given type. Works with ElementType, FamilyType, ViewFamilyType, Wall/Floor/Roof/CeilingType, GroupType, FilledRegionType and TextNoteType.
count_3 = List.Count(list=all_elements_of_type@L2)
python_script_7 = Python(IN[0]=all_elements_of_type, IN[1]=count_3)  # IronPython2
# ---------- python_script_7.python (18 lines) ----------
# Load the Python Standard and DesignScript Libraries
import sys
import clr
clr.AddReference('ProtoGeometry')
from Autodesk.DesignScript.Geometry import *

# The inputs to this node will be stored as a list in the IN variables.
list = IN[0]
count = IN[1]

OUT=[]

# Place your code below this line
for i in xrange(len(list)):
	if count[i]==1:
		OUT.append([list[i]])
	else:
		OUT.append(list[i])
# ----------------------------------------
id_2 = Element.Id(element=python_script_7)
fill_patterns = FillPatterns("<Solid fill>")
id_3 = Element.Id(element=fill_patterns)
UI_AssignConstruction_2 = HDLab_ZeroTouch.LCAByg.UI_AssignConstruction_2(wall=end, constructions=ofRepeatedItem, assignedcnstructions=python_script_3, assignedcnstructionsbool=python_script_5, assignedcnstructionsindex=toNumber, preassigned=anyTrue, doc=lastItem, allElementsId=id, idByType=id_2, fillPattern=id_3, uidoc=firstItem_3)
python_script_8 = Python(IN[0]=UI_AssignConstruction_2)  # IronPython2
# ---------- python_script_8.python (16 lines) ----------
# Load the Python Standard and DesignScript Libraries
import sys
import clr
clr.AddReference('ProtoGeometry')
from Autodesk.DesignScript.Geometry import *

# The inputs to this node will be stored as a list in the IN variables.
indexes = IN[0]
OUT=[]

# Place your code below this line
for i in xrange(len(indexes)):
	if indexes[i]==None:
		OUT.append([])
	else:
		OUT.append(indexes[i])
# ----------------------------------------
getItemAtIndex_5 = List.GetItemAtIndex(list=ofRepeatedItem@L2, index=python_script_8@L2)
join = String.Join(separator=code_block_2, string0=getItemAtIndex_5)
flatten = List.Flatten(list=join)

# group: Set parameters value (CB component)
passthrough = Custom[Passthrough](passThrough=uniqueItems, waitFor=createProjectParameter)  # package Clockwork for Dynamo 2.x; Forces a sequential order of execution. The node wired into the output of the Passthrough node will be executed *after* the node wired into the waitFor input (e.g. important for some Revit operations). The value of the passThrough input will be passed on to the node wired into the output port of the Passthrough node.
setParameterByName = Element.SetParameterByName(element=passthrough, parameterName=code_block.out0, value=flatten)

string_from_object_2 = FromObject(object=python_script_8)
join_2 = String.Join(separator=code_block_2, string0=string_from_object_2)
flatten_2 = List.Flatten(list=join_2)

# group: Set parameters value (CB component)
passthrough_2 = Custom[Passthrough](passThrough=uniqueItems, waitFor=createProjectParameter)
setParameterByName_2 = Element.SetParameterByName(element=passthrough_2, parameterName=code_block.out1, value=flatten_2)
