# Dynamo graph script.dyn (Dynamo 2.12.0.5650)
# packages: Genius Loci 2022.1.5

# group: UI Selection
python_script = Python()  # IronPython2; unwired: IN[0]
# ---------- python_script.python (18 lines) ----------
# Load the Python Standard and DesignScript Libraries
import sys
import clr
clr.AddReference('ProtoGeometry')
from Autodesk.DesignScript.Geometry import *
clr.AddReference("RevitServices")
import RevitServices
from RevitServices.Persistence import DocumentManager

# The inputs to this node will be stored as a list in the IN variables.


# Place your code below this line
uidoc = DocumentManager.Instance.CurrentUIApplication.ActiveUIDocument
doc = uidoc.Document

# Assign your output to the OUT variable.
OUT = [uidoc,doc]
# ----------------------------------------
firstItem = List.FirstItem(list=python_script)
lastItem = List.LastItem(list=python_script)
UI_Select = HDLab_ZeroTouch.CircleBank.UI_Select(uidoc=firstItem, doc=lastItem)
python_script_2 = Python(IN[0]=UI_Select)  # IronPython2
# ---------- python_script_2.python (13 lines) ----------
# Load the Python Standard and DesignScript Libraries
import sys
import clr
clr.AddReference('ProtoGeometry')
from Autodesk.DesignScript.Geometry import *

# The inputs to this node will be stored as a list in the IN variables.
element= IN[0]

# Place your code below this line

# Assign your output to the OUT variable.
OUT = element
# ----------------------------------------
elementType = Element.ElementType(element=python_script_2)
all_elements_of_type = Custom[All Elements of Type+](type=elementType)  # package Genius Loci; Get the instances of the given type. Works with ElementType, FamilyType, ViewFamilyType, Wall/Floor/Roof/CeilingType, GroupType, FilledRegionType and TextNoteType.
count = List.Count(list=all_elements_of_type)
python_script_3 = Python(IN[0]=all_elements_of_type, IN[1]=count)  # IronPython2
# ---------- python_script_3.python (17 lines) ----------
# Load the Python Standard and DesignScript Libraries
import sys
import clr
clr.AddReference('ProtoGeometry')
from Autodesk.DesignScript.Geometry import *

# The inputs to this node will be stored as a list in the IN variables.
list_ = IN[0]
count = IN[1]
list = []

# Place your code below this line
if count>1:
	OUT=list_
else:
	list.append(list_)
	OUT = list
# ----------------------------------------
select_in_revit = Python(IN[0]=python_script_3)  # IronPython2
# ---------- select_in_revit.python (28 lines) ----------
import clr

clr.AddReference("RevitNodes")
import Revit
clr.ImportExtensions(Revit.Elements)

clr.AddReference("RevitServices")
import RevitServices
from RevitServices.Persistence import DocumentManager
from System.Collections.Generic import *

# Import RevitAPI
clr.AddReference("RevitAPI")
import Autodesk
from Autodesk.Revit.DB import *

doc = DocumentManager.Instance.CurrentDBDocument
uidoc = DocumentManager.Instance.CurrentUIApplication.ActiveUIDocument

element = UnwrapElement(IN[0])

elementIdList = List[ElementId]()
for i in xrange(len(IN[0])):
	elementIdList.Add(element[i].Id)

sel = uidoc.Selection.SetElementIds(elementIdList)

OUT = True
# ----------------------------------------
getCategory = Element.GetCategory(element=elementType)
name = Category.Name(category=getCategory)

# group: Reading JSON
readDatabase = HDLab_ZeroTouch.CircleBank.ReadDatabase()
parseJSON = Data.ParseJSON(json=readDatabase)
code_block = CodeBlock { "materialtypes"; }
valueAtKey = DesignScript.Builtin.Dictionary.ValueAtKey(dictionary=parseJSON, key=code_block)

# group: Category sorting
values = DesignScript.Builtin.Dictionary.Values(dictionary=valueAtKey)
code_block_2 = CodeBlock { "componentcategory"; }
valueAtKey_2 = DesignScript.Builtin.Dictionary.ValueAtKey(dictionary=values, key=code_block_2)
sortByKey = List.SortByKey(list=values, keys=valueAtKey_2)
groupByKey = List.GroupByKey(list=sortByKey.sortedList, keys=sortByKey.sortedKeys)

# group: Deal with CB categories
translator = Python(IN[0]=groupByKey.uniqueKeys)  # IronPython2
# ---------- translator.python (50 lines) ----------
# Load the Python Standard and DesignScript Libraries
import sys
import clr
clr.AddReference('ProtoGeometry')
from Autodesk.DesignScript.Geometry import *

# The inputs to this node will be stored as a list in the IN variables.
danish = IN[0]
english=[]

# Place your code below this line
for i in xrange (len(danish)):
	if danish[i] == "Træ":
		english.append("Wood")
	elif danish[i] == "Metal":
		english.append("Metal Panel")
	elif danish[i] == "Plast":
		english.append("Plastic")
	elif danish[i] == "Vindue":
		english.append("Windows")
	elif danish[i] == "Bjælke":
		english.append("Structural Framing")
	elif danish[i] == "Dør":
		english.append("Doors")
	elif danish[i] == "Gulv":
		english.append("Floors")
	elif danish[i] == "Væg":
		english.append("Walls")
	elif danish[i] == "Udvendige Vinduer":
		english.append("Windows")
	elif danish[i] == "Udvendige Døre":
		english.append("Doors")
	elif danish[i] == "Etagedæk":
		english.append("Floors")
	elif danish[i] == "Facade":
		english.append("Walls")
	elif danish[i] == "Indvendige Døre":
		english.append("Doors")
	elif danish[i] == "Indvendige Vægge":
		english.append("Walls")
	elif danish[i] == "Loft":
		english.append("Ceilings")
	elif danish[i] == "Ydervæg":
		english.append("Walls")
	elif danish[i] == "Exterior Door":
		english.append("Doors")
	elif danish[i] == "Tag":
		english.append("Roofs")
# Assign your output to the OUT variable.
OUT = english
# ----------------------------------------
groupByKey_2 = List.GroupByKey(list=groupByKey.groups, keys=translator)
indexOf = List.IndexOf(list=groupByKey_2.uniqueKeys, element=name)
getItemAtIndex = List.GetItemAtIndex(list=groupByKey_2.uniqueKeys, index=indexOf)
getItemAtIndex_2 = List.GetItemAtIndex(list=groupByKey_2.groups, index=indexOf)
flatten = List.Flatten(list=getItemAtIndex_2)

# group: Get material and thickness from CB database
code_block_3 = CodeBlock { "interiormaterial"; "height"; "width"; }
valueAtKey_3 = DesignScript.Builtin.Dictionary.ValueAtKey(dictionary=flatten, key=code_block_3.out0)
translator_2 = Python(IN[0]=valueAtKey_3)  # IronPython2
# ---------- translator_2.python (50 lines) ----------
# Load the Python Standard and DesignScript Libraries
import sys
import clr
clr.AddReference('ProtoGeometry')
from Autodesk.DesignScript.Geometry import *

# The inputs to this node will be stored as a list in the IN variables.
danish = IN[0]
english=[]

# Place your code below this line
for i in xrange (len(danish)):
	if danish[i] == "Træ":
		english.append("Wood")
	elif danish[i] == "Trægulv":
		english.append("Wood")
	elif danish[i] == "Metal":
		english.append("Metal Panel")
	elif danish[i] == "Plast":
		english.append("Plastic")
	elif danish[i] == "Vindue":
		english.append("Windows")
	elif danish[i] == "Bjælke":
		english.append("Structural Framing")
	elif danish[i] == "Dør":
		english.append("Doors")
	elif danish[i] == "Gulv":
		english.append("Floors")
	elif danish[i] == "Væg":
		english.append("Walls")
	elif danish[i] == "Udvendige Vinduer":
		english.append("Windows")
	elif danish[i] == "Udvendige Døre":
		english.append("Doors")
	elif danish[i] == "Etagedæk":
		english.append("Floors")
	elif danish[i] == "Facade":
		english.append("Walls")
	elif danish[i] == "Indvendige Døre":
		english.append("Doors")
	elif danish[i] == "Indvendige Vægge":
		english.append("Walls")
	elif danish[i] == "Loft":
		english.append("Ceilings")
	elif danish[i] == "Ydervæg":
		english.append("Walls")
	elif danish[i] == "Gips og maling":
		english.append("Gypsum Wall Board")
# Assign your output to the OUT variable.
OUT = english
# ----------------------------------------
byName = Material.ByName(name=translator_2)
code_block_4 = CodeBlock { "Floors"; }
eq = name == code_block_4
valueAtKey_4 = DesignScript.Builtin.Dictionary.ValueAtKey(dictionary=flatten, key=code_block_3.out1)
code_block_5 = CodeBlock(x=valueAtKey_4) { x*10; }
valueAtKey_5 = DesignScript.Builtin.Dictionary.ValueAtKey(dictionary=flatten, key=code_block_3.out2)
code_block_6 = CodeBlock(x=valueAtKey_5) { x*10; }
if_ = RefactoredIf(test=eq, true=code_block_5, false=code_block_6)

get_compoundstructurelayers = Custom[Get CompoundStructureLayers](ElementOrFamilyType=elementType)  # package Genius Loci; Retrieves the properties of the compound layers of wall, floor, roof or ceiling Type.

# group: UI_compound
code_block_7 = CodeBlock { "title"; "quality"; "materialid"; }
valueAtKey_6 = DesignScript.Builtin.Dictionary.ValueAtKey(dictionary=flatten, key=code_block_7.out0)
valueAtKey_7 = DesignScript.Builtin.Dictionary.ValueAtKey(dictionary=flatten, key=code_block_7.out1)
valueAtKey_8 = DesignScript.Builtin.Dictionary.ValueAtKey(dictionary=flatten, key=code_block_7.out2)
string_from_object = FromObject(object=valueAtKey_8)
list_create = List.Create(item0=valueAtKey_6, item1=if_, item2=valueAtKey_3, item3=valueAtKey_7, item4=string_from_object)
transpose = List.Transpose(lists=list_create)
string_from_object_2 = FromObject(object=get_compoundstructurelayers.LayerFunction)
enumerate_layerfunction = Custom[Enumerate LayerFunction]()  # package Genius Loci; Enumerate the functions of the layers of the Compound System Family.
string_from_object_3 = FromObject(object=enumerate_layerfunction)
UI_CompoundElements = HDLab_ZeroTouch.CircleBank.UI_CompoundElements(DB=transpose, layerfunction=string_from_object_2, alllayerfunction=string_from_object_3)

# group: Branch Add / Replace
lastItem_2 = List.LastItem(list=UI_CompoundElements)
code_block_8 = CodeBlock(x=elementType) { [x, null]; [null, x]; }
if_2 = RefactoredIf(test=lastItem_2, true=code_block_8.out0, false=code_block_8.out1)
lastItem_3 = List.LastItem(list=if_2)
firstItem_2 = List.FirstItem(list=if_2)

# group: Add layer
code_block_9 = CodeBlock { 1; 2; }
getItemAtIndex_3 = List.GetItemAtIndex(list=UI_CompoundElements, index=code_block_9.out0)
firstItem_3 = List.FirstItem(list=UI_CompoundElements)
indexOf_2 = List.IndexOf(list=string_from_object, element=firstItem_3)
getItemAtIndex_4 = List.GetItemAtIndex(list=valueAtKey_3, index=indexOf_2)
translator_3 = Python(IN[0]=getItemAtIndex_4)  # IronPython2
# ---------- translator_3.python (48 lines) ----------
# Load the Python Standard and DesignScript Libraries
import sys
import clr
clr.AddReference('ProtoGeometry')
from Autodesk.DesignScript.Geometry import *

# The inputs to this node will be stored as a list in the IN variables.
danish = IN[0]

# Place your code below this line
if danish == "Træ":
	english = "Wood"
elif danish == "Trægulv":
	english = "Wood"
elif danish == "Metal":
	english = "Metal Panel"
elif danish == "Plast":
	english = "Plastic"
elif danish == "Vindue":
	eenglish = "Windows"
elif danish == "Bjælke":
	english = "Structural Framing"
elif danish == "Dør":
	english = "Doors"
elif danish == "Gulv":
	english = "Floors"
elif danish == "Væg":
	english = "Walls"
elif danish == "Udvendige Vinduer":
	english = "Windows"
elif danish == "Udvendige Døre":
	english = "Doors"
elif danish == "Etagedæk":
	english = "Floors"
elif danish == "Facade":
	english = "Walls"
elif danish == "Indvendige Døre":
	english = "Doors"
elif danish == "Indvendige Vægge":
	english = "Walls"
elif danish == "Loft":
	english = "Ceilings"
elif danish == "Ydervæg":
	english = "Walls"
elif danish == "Gips og maling":
	english = "Gypsum Wall Board"
# Assign your output to the OUT variable.
OUT = english
# ----------------------------------------
getItemAtIndex_5 = List.GetItemAtIndex(list=if_, index=indexOf_2)
getItemAtIndex_6 = List.GetItemAtIndex(list=UI_CompoundElements, index=code_block_9.out1)
count_2 = List.Count(list=get_compoundstructurelayers.Index)
python_script_4 = Python(IN[0]=getItemAtIndex_6, IN[1]=count_2)  # IronPython2
# ---------- python_script_4.python (15 lines) ----------
# Load the Python Standard and DesignScript Libraries
import sys
import clr
clr.AddReference('ProtoGeometry')
from Autodesk.DesignScript.Geometry import *

# The inputs to this node will be stored as a list in the IN variables.
test = IN[0]
count = IN[1]

# Place your code below this line
if test == "External / Top":
	OUT = 0
elif test == "Internal / Bottom":
	OUT = count
# ----------------------------------------
byName_2 = Material.ByName(name=translator_3)

material_create = Custom[Material Create](Name=translator_3)  # package Genius Loci; Create new materials or overwrite properties of existing materials. (All graphics inputs are optional)

# group (continued): Add layer
create_compound_layer = Custom[Create Compound Layer](ElementOrFamilyType=lastItem_3, LayerFunction=getItemAtIndex_3, material=material_create, Thickness=getItemAtIndex_5, index=python_script_4)  # package Genius Loci; Creates a new layer at the specified index in the compound system family (wall, floor, roof or ceiling).

# group: Replace layer
string_from_object_4 = FromObject(object=get_compoundstructurelayers.LayerFunction)
indexOf_3 = List.IndexOf(list=string_from_object_4, element=getItemAtIndex_3)
getItemAtIndex_7 = List.GetItemAtIndex(list=get_compoundstructurelayers.Index, index=indexOf_3)
delete_compound_layer = Custom[Delete Compound Layer](ElementOrFamilyType=firstItem_2, index=getItemAtIndex_7)  # package Genius Loci; Removes a layer at the given index in the compound system family (wall, floor, roof or ceiling).
create_compound_layer_2 = Custom[Create Compound Layer](ElementOrFamilyType=delete_compound_layer, LayerFunction=getItemAtIndex_3, material=material_create, Thickness=getItemAtIndex_5, index=getItemAtIndex_7)
