# Dynamo graph script.dyn (Dynamo 2.12.0.5650)
# packages: GIS2BIM for Dynamo 2.x 0.11.23

# group: Collect all CB components in the model
all_elements_in_active_view = ElementsInView()
elementType = Element.ElementType(element=all_elements_in_active_view)
boolean = BoolSelector(false)
clean = List.Clean(list=elementType, preserveIndices=boolean)
code_block = CodeBlock { "CB component ID"; }
parameterByName = Parameter.ParameterByName(element=clean, name=code_block)
value = Parameter.Value(parameter=parameterByName)
python_script = Python(IN[0]=value)  # IronPython2
# ---------- python_script.python (17 lines) ----------
# Load the Python Standard and DesignScript Libraries
import sys
import clr
clr.AddReference('ProtoGeometry')
from Autodesk.DesignScript.Geometry import *

# The inputs to this node will be stored as a list in the IN variables.
value = IN[0]
list = []

# Place your code below this line
for i in xrange(len(value)):
	if value[i] != "" and value[i] != None:
		list.append(i)

# Assign your output to the OUT variable.
OUT = list
# ----------------------------------------
getItemAtIndex = List.GetItemAtIndex(list=clean, index=python_script)
identity = Object.Identity()  # unwired: object
groupByFunction = List.GroupByFunction(list=getItemAtIndex, groupFunction=identity)
firstItem = List.FirstItem(list=groupByFunction@L2)

# group: UI Report
code_block_2 = CodeBlock { "No Circle Bank components has been found in the current view."; }
firstItem_2 = List.FirstItem(list=firstItem)
python_script_2 = Python(IN[0]=code_block_2, IN[1]=firstItem_2)  # IronPython2
# ---------- python_script_2.python (15 lines) ----------
# Load the Python Standard and DesignScript Libraries
import sys
import clr
clr.AddReference('ProtoGeometry')
from Autodesk.DesignScript.Geometry import *

# The inputs to this node will be stored as a list in the IN variables.
run = IN[0]
test = IN[1]

# Place your code below this line
if test == None:
	OUT = run
else:
	OUT = 0
# ----------------------------------------
UI_Report = HDLab_ZeroTouch.CircleBank.UI_Report(text=python_script_2)

# group: Reading JSON
readDatabase = HDLab_ZeroTouch.CircleBank.ReadDatabase()
parseJSON = Data.ParseJSON(json=readDatabase)
code_block_3 = CodeBlock { "materialtypes"; }
valueAtKey = DesignScript.Builtin.Dictionary.ValueAtKey(dictionary=parseJSON, key=code_block_3)

values = DesignScript.Builtin.Dictionary.Values(dictionary=valueAtKey)

# group: Find correspondent components on CB database
code_block_4 = CodeBlock { "materialid"; }
valueAtKey_2 = DesignScript.Builtin.Dictionary.ValueAtKey(dictionary=values, key=code_block_4)
code_block_5 = CodeBlock { "CB component ID"; }
parameterByName_2 = Parameter.ParameterByName(element=firstItem, name=code_block_5)
value_2 = Parameter.Value(parameter=parameterByName_2)
indexOf = List.IndexOf(list=valueAtKey_2, element=value_2)
getItemAtIndex_2 = List.GetItemAtIndex(list=values, index=indexOf)

code_block_6 = CodeBlock { "projects"; }
valueAtKey_3 = DesignScript.Builtin.Dictionary.ValueAtKey(dictionary=parseJSON, key=code_block_6)
values_2 = DesignScript.Builtin.Dictionary.Values(dictionary=valueAtKey_3)

# group: UI Satellite Map
GIS2BIM_GetRevitSiteLocation = Custom[GIS2BIM_GetRevitSiteLocation]()  # package GIS2BIM for Dynamo 2.x; Gets the properties of the current Site Location of the active Revit Project
toNumber = String.ToNumber(string=GIS2BIM_GetRevitSiteLocation.Lat)
toNumber_2 = String.ToNumber(string=GIS2BIM_GetRevitSiteLocation.Lon)
code_block_7 = CodeBlock { "projectid"; }
valueAtKey_4 = DesignScript.Builtin.Dictionary.ValueAtKey(dictionary=getItemAtIndex_2, key=code_block_7)
valueAtKey_5 = DesignScript.Builtin.Dictionary.ValueAtKey(dictionary=values_2, key=code_block_7)
code_block_8 = CodeBlock { "address"; "loc_lat"; "loc_lng"; }
valueAtKey_6 = DesignScript.Builtin.Dictionary.ValueAtKey(dictionary=values_2, key=code_block_8.out0)
valueAtKey_7 = DesignScript.Builtin.Dictionary.ValueAtKey(dictionary=values_2, key=code_block_8.out1)
valueAtKey_8 = DesignScript.Builtin.Dictionary.ValueAtKey(dictionary=values_2, key=code_block_8.out2)
python_script_3 = Python(IN[0]=valueAtKey_4, IN[1]=valueAtKey_5, IN[2]=valueAtKey_6, IN[3]=valueAtKey_7, IN[4]=valueAtKey_8)  # IronPython2
# ---------- python_script_3.python (54 lines) ----------
# Load the Python Standard and DesignScript Libraries
import sys
import clr
clr.AddReference('ProtoGeometry')
from Autodesk.DesignScript.Geometry import *

# The inputs to this node will be stored as a list in the IN variables.
itemsID = IN[0]
projectID = IN[1]
address = IN[2]
latitude = IN[3]
longitude = IN[4]

location = []
lat = []
lng = []

# Place your code below this line
for i in xrange (len(itemsID)):
	if itemsID[i] == projectID[0]:
		location.append(address[0])
		lat.append(latitude[0])
		lng.append(longitude[0])
	elif itemsID[i] == projectID[1]:
		location.append(address[1])
		lat.append(latitude[1])
		lng.append(longitude[1])
	elif itemsID[i] == projectID[2]:
		location.append(address[2])
		lat.append(latitude[2])
		lng.append(longitude[2])
	elif itemsID[i] == projectID[3]:
		location.append(address[3])
		lat.append(latitude[3])
		lng.append(longitude[3])
	elif itemsID[i] == projectID[4]:
		location.append(address[4])
		lat.append(latitude[4])
		lng.append(longitude[4])
	elif itemsID[i] == projectID[5]:
		location.append(address[5])
		lat.append(latitude[5])
		lng.append(longitude[5])
	elif itemsID[i] == projectID[6]:
		location.append(address[6])
		lat.append(latitude[6])
		lng.append(longitude[6])
	elif itemsID[i] == projectID[7]:
		location.append(address[7])
		lat.append(latitude[7])
		lng.append(longitude[7])

# Assign your output to the OUT variable.
OUT = [location, lat, lng]
# ----------------------------------------
code_block_9 = CodeBlock { 1; 2; }
getItemAtIndex_3 = List.GetItemAtIndex(list=python_script_3, index=code_block_9.out0)
uniqueItems = List.UniqueItems(list=getItemAtIndex_3)
python_script_4 = Python(IN[0]=uniqueItems)  # IronPython2
# ---------- python_script_4.python (14 lines) ----------
# Load the Python Standard and DesignScript Libraries
import sys
import clr
clr.AddReference('ProtoGeometry')
from Autodesk.DesignScript.Geometry import *

# The inputs to this node will be stored as a list in the IN variables.
list = IN[0]

# Place your code below this line
if len(list) == 0:
	OUT = None
else:
	OUT = list
# ----------------------------------------
getItemAtIndex_4 = List.GetItemAtIndex(list=python_script_3, index=code_block_9.out1)
uniqueItems_2 = List.UniqueItems(list=getItemAtIndex_4)
code_block_10 = CodeBlock { -2; 2; }
remove = String.Remove(string=GIS2BIM_GetRevitSiteLocation.Name, startIndex=code_block_10.out0, count=code_block_10.out1)

# group: Tooltip
firstItem_3 = List.FirstItem(list=python_script_3)
uniqueItems_3 = List.UniqueItems(list=firstItem_3)
python_script_5 = Python(IN[0]=uniqueItems_3)  # IronPython2
# ---------- python_script_5.python (13 lines) ----------
# Load the Python Standard and DesignScript Libraries
import sys
import clr
clr.AddReference('ProtoGeometry')
from Autodesk.DesignScript.Geometry import *

# The inputs to this node will be stored as a list in the IN variables.
addresses = IN[0]
OUT = []

# Place your code below this line
for i in xrange(len(addresses)):
	OUT.append("Doner location: " + str(addresses[i]))
# ----------------------------------------
GIS2BIM_DistanceBetweenCoordinatesWGS84 = Custom[GIS2BIM_DistanceBetweenCoordinatesWGS84](Latitude1=uniqueItems, Longitude1=uniqueItems_2, Latitude2=toNumber, Longitude2=toNumber_2)  # package GIS2BIM for Dynamo 2.x; Calculate the distance between 2 lat/lon coördinates in meters
code_block_11 = CodeBlock(x=GIS2BIM_DistanceBetweenCoordinatesWGS84) { Math.Round(x/1000,2); }
python_script_6 = Python(IN[0]=code_block_11)  # IronPython2
# ---------- python_script_6.python (13 lines) ----------
# Load the Python Standard and DesignScript Libraries
import sys
import clr
clr.AddReference('ProtoGeometry')
from Autodesk.DesignScript.Geometry import *

# The inputs to this node will be stored as a list in the IN variables.
dist = IN[0]
OUT = []

# Place your code below this line
for i in xrange(len(dist)):
	OUT.append("Distance from project location: " + str(dist[i])+ "Km")
# ----------------------------------------
groupByKey = List.GroupByKey(list=groupByFunction, keys=firstItem_3)
getCategory = Element.GetCategory(element=groupByKey.groups)
firstItem_4 = List.FirstItem(list=getCategory@@L2)
string_from_object = FromObject(object=firstItem_4)
python_script_7 = Python(IN[0]=string_from_object)  # IronPython2
# ---------- python_script_7.python (13 lines) ----------
# Load the Python Standard and DesignScript Libraries
import sys
import clr
clr.AddReference('ProtoGeometry')
from Autodesk.DesignScript.Geometry import *

# The inputs to this node will be stored as a list in the IN variables.
comp = IN[0]
OUT=[]


for i in xrange(len(comp)):
	OUT.append("Components: ")
# ----------------------------------------
code_block_12 = CodeBlock { ", "; }
count = List.Count(list=getCategory@@L2)
string_from_object_2 = FromObject(object=count)
code_block_13 = CodeBlock(x=string_from_object_2, y=string_from_object) { x+" "+y; }
join = String.Join(separator=code_block_12, string0=code_block_13)
flatten = List.Flatten(list=join)
code_block_14 = CodeBlock(x=python_script_7, y=flatten) { x+y; }
python_script_8 = Python(IN[0]=python_script_5, IN[1]=python_script_6, IN[2]=code_block_14)  # IronPython2
# ---------- python_script_8.python (15 lines) ----------
# Load the Python Standard and DesignScript Libraries
import sys
import clr
clr.AddReference('ProtoGeometry')
from Autodesk.DesignScript.Geometry import *

# The inputs to this node will be stored as a list in the IN variables.
location = IN[0]
dist = IN[1]
comp = IN[2]
OUT=[]

# Place your code below this line
for i in xrange(len(dist)):
	OUT.append(location[i] + "\n" + dist[i] + "\n" + comp[i])
# ----------------------------------------

# group (continued): UI Satellite Map
UI_Googlemap = HDLab_ZeroTouch.CircleBank.UI_Googlemap(latitude=toNumber, longitude=toNumber_2, lats=python_script_4, longs=uniqueItems_2, projectLocation=remove, donerLocation=python_script_8)
