# Dynamo graph script.dyn (Dynamo 2.12.0.5650)
# packages: Genius Loci 2022.1.5

# group: Collect all CB components in the model
all_elements_in_active_view = ElementsInView()
elementType = Element.ElementType(element=all_elements_in_active_view)
boolean = BoolSelector(false)
clean = List.Clean(list=elementType, preserveIndices=boolean)
code_block = CodeBlock { "CB component ID"; }
parameterByName = Parameter.ParameterByName(element=clean, name=code_block)
value = Parameter.Value(parameter=parameterByName)
python_script = Python(IN[0]=value)  # IronPython2
# ---------- python_script.python (17 lines) ----------
# Load the Python Standard and DesignScript Libraries
import sys
import clr
clr.AddReference('ProtoGeometry')
from Autodesk.DesignScript.Geometry import *

# The inputs to this node will be stored as a list in the IN variables.
value = IN[0]
list = []

# Place your code below this line
for i in xrange(len(value)):
	if value[i] != "" and value[i] != None:
		list.append(i)

# Assign your output to the OUT variable.
OUT = list
# ----------------------------------------
getItemAtIndex = List.GetItemAtIndex(list=clean, index=python_script)

identity = Object.Identity()  # unwired: object
groupByFunction = List.GroupByFunction(list=getItemAtIndex, groupFunction=identity)
firstItem = List.FirstItem(list=groupByFunction@L2)
all_elements_of_type = Custom[All Elements of Type+](type=firstItem)  # package Genius Loci; Get the instances of the given type. Works with ElementType, FamilyType, ViewFamilyType, Wall/Floor/Roof/CeilingType, GroupType, FilledRegionType and TextNoteType.
flatten = List.Flatten(list=all_elements_of_type)
count = List.Count(list=flatten)
python_script_2 = Python(IN[0]=flatten, IN[1]=count)  # IronPython2
# ---------- python_script_2.python (17 lines) ----------
# Load the Python Standard and DesignScript Libraries
import sys
import clr
clr.AddReference('ProtoGeometry')
from Autodesk.DesignScript.Geometry import *

# The inputs to this node will be stored as a list in the IN variables.
list_ = IN[0]
count = IN[1]
list = []

# Place your code below this line
if count>1:
	OUT=list_
else:
	list.append(list_)
	OUT = list
# ----------------------------------------
select_in_revit = Python(IN[0]=flatten)  # IronPython2
# ---------- select_in_revit.python (28 lines) ----------
import clr

clr.AddReference("RevitNodes")
import Revit
clr.ImportExtensions(Revit.Elements)

clr.AddReference("RevitServices")
import RevitServices
from RevitServices.Persistence import DocumentManager
from System.Collections.Generic import *

# Import RevitAPI
clr.AddReference("RevitAPI")
import Autodesk
from Autodesk.Revit.DB import *

doc = DocumentManager.Instance.CurrentDBDocument
uidoc = DocumentManager.Instance.CurrentUIApplication.ActiveUIDocument

element = UnwrapElement(IN[0])

elementIdList = List[ElementId]()
for i in xrange(len(IN[0])):
	elementIdList.Add(element[i].Id)

sel = uidoc.Selection.SetElementIds(elementIdList)

OUT = True
# ----------------------------------------
