# Dynamo graph script.dyn (Dynamo 2.12.0.5650)

# group: Reading JSON
readDatabase = HDLab_ZeroTouch.CircleBank.ReadDatabase()
parseJSON = Data.ParseJSON(json=readDatabase)
code_block = CodeBlock { "materialtypes"; }
valueAtKey = DesignScript.Builtin.Dictionary.ValueAtKey(dictionary=parseJSON, key=code_block)
values = DesignScript.Builtin.Dictionary.Values(dictionary=valueAtKey)

# group: Collect all CB components in the model
all_elements_in_active_view = ElementsInView()
elementType = Element.ElementType(element=all_elements_in_active_view)
boolean = BoolSelector(false)
clean = List.Clean(list=elementType, preserveIndices=boolean)
code_block_2 = CodeBlock { "Original Revit component ID"; }
parameterByName = Parameter.ParameterByName(element=clean, name=code_block_2)
value = Parameter.Value(parameter=parameterByName)
python_script = Python(IN[0]=value)  # IronPython2
# ---------- python_script.python (17 lines) ----------
# Load the Python Standard and DesignScript Libraries
import sys
import clr
clr.AddReference('ProtoGeometry')
from Autodesk.DesignScript.Geometry import *

# The inputs to this node will be stored as a list in the IN variables.
value = IN[0]
list = []

# Place your code below this line
for i in xrange(len(value)):
	if value[i] != 0 and value[i] != None:
		list.append(i)

# Assign your output to the OUT variable.
OUT = list
# ----------------------------------------
getItemAtIndex = List.GetItemAtIndex(list=clean, index=python_script)
identity = Object.Identity()  # unwired: object
groupByFunction = List.GroupByFunction(list=getItemAtIndex, groupFunction=identity)
firstItem = List.FirstItem(list=groupByFunction@L2)

# group: Collect disabled CB components in the model
code_block_3 = CodeBlock { "CB Revit component ID"; }
parameterByName_2 = Parameter.ParameterByName(element=clean, name=code_block_3)
value_2 = Parameter.Value(parameter=parameterByName_2)
python_script_2 = Python(IN[0]=value_2)  # IronPython2
# ---------- python_script_2.python (17 lines) ----------
# Load the Python Standard and DesignScript Libraries
import sys
import clr
clr.AddReference('ProtoGeometry')
from Autodesk.DesignScript.Geometry import *

# The inputs to this node will be stored as a list in the IN variables.
value = IN[0]
list = []

# Place your code below this line
for i in xrange(len(value)):
	if value[i] != 0 and value[i] != None:
		list.append(value[i])

# Assign your output to the OUT variable.
OUT = list
# ----------------------------------------
uniqueItems = List.UniqueItems(list=python_script_2)
element_by_id = ElementById(Id=uniqueItems)

join = List.Join(list0=firstItem, list1=element_by_id)
boolean_2 = BoolSelector(false)
clean_2 = List.Clean(list=join, preserveIndices=boolean_2)

# group: Find correspondent components on CB database
code_block_4 = CodeBlock { "materialid"; }
valueAtKey_2 = DesignScript.Builtin.Dictionary.ValueAtKey(dictionary=values, key=code_block_4)
code_block_5 = CodeBlock { "CB component ID"; }
parameterByName_3 = Parameter.ParameterByName(element=clean_2, name=code_block_5)
value_3 = Parameter.Value(parameter=parameterByName_3)
indexOf = List.IndexOf(list=valueAtKey_2, element=value_3)
getItemAtIndex_2 = List.GetItemAtIndex(list=values, index=indexOf)

code_block_6 = CodeBlock { "Original Revit component ID"; }
parameterByName_4 = Parameter.ParameterByName(element=clean_2, name=code_block_6)
value_4 = Parameter.Value(parameter=parameterByName_4)
element_from_id = Python(IN[0]=value_4)  # IronPython2; unwired: IN[1]
# ---------- element_from_id.python (30 lines) ----------
import clr
clr.AddReference('RevitAPI')
from Autodesk.Revit.DB import *

clr.AddReference("RevitNodes")
import Revit
clr.ImportExtensions(Revit.Elements)

clr.AddReference("RevitServices")
import RevitServices
from RevitServices.Persistence import DocumentManager

def ElementById(item, doc):
	try: 
		return doc.GetElement(item).ToDSType(True)
	except:
		try:
			return doc.GetElement(ElementId(item)).ToDSType(True)
		except:
			return None

items = UnwrapElement(IN[0])
inputdoc = UnwrapElement(IN[1])
if not inputdoc: doc = DocumentManager.Instance.CurrentDBDocument
elif inputdoc.GetType().ToString() == "Autodesk.Revit.DB.RevitLinkInstance": doc = inputdoc.GetLinkDocument()
elif inputdoc.GetType().ToString() == "Autodesk.Revit.DB.Document": doc = inputdoc
else: doc = DocumentManager.Instance.CurrentDBDocument

if isinstance(IN[0], list): OUT = [ElementById(x, doc) for x in items]
else: OUT = ElementById(items, doc)
# ----------------------------------------
python_script_3 = Python(IN[0]=clean_2, IN[1]=firstItem, IN[2]=element_by_id)  # IronPython2
# ---------- python_script_3.python (19 lines) ----------
# Load the Python Standard and DesignScript Libraries
import sys
import clr
clr.AddReference('ProtoGeometry')
from Autodesk.DesignScript.Geometry import *

# The inputs to this node will be stored as a list in the IN variables.
whole = IN[0]
enabled = IN[1]
disabled = IN[2]

OUT = []

# Place your code below this line
for i in xrange (len(whole)):
	if whole[i] in enabled:
		OUT.append(True)
	elif whole[i] in disabled:
		OUT.append(False)
# ----------------------------------------

# group: Get input parameters
code_block_7 = CodeBlock { "title"; "componentcategory"; }
valueAtKey_3 = DesignScript.Builtin.Dictionary.ValueAtKey(dictionary=getItemAtIndex_2, key=code_block_7.out0)
valueAtKey_4 = DesignScript.Builtin.Dictionary.ValueAtKey(dictionary=getItemAtIndex_2, key=code_block_7.out1)
id = Element.Id(element=clean_2)
name = FamilyType.Name(familyType=clean_2)
family = FamilyType.Family(familyType=clean_2)
name_2 = Family.Name(family=family)
name_3 = FamilyType.Name(familyType=element_from_id)
family_2 = FamilyType.Family(familyType=element_from_id)
name_4 = Family.Name(family=family_2)
list_create = List.Create(item0=valueAtKey_3, item1=valueAtKey_4, item2=id, item3=value_4, item4=name, item5=name_2, item6=name_3, item7=name_4, item8=python_script_3)
transpose = List.Transpose(lists=list_create)

end = Revit.Transaction.Transaction.End(input=transpose)

# group: doc
python_script_4 = Python()  # IronPython2; unwired: IN[0]
# ---------- python_script_4.python (18 lines) ----------
# Load the Python Standard and DesignScript Libraries
import sys
import clr
clr.AddReference('ProtoGeometry')
from Autodesk.DesignScript.Geometry import *
clr.AddReference("RevitServices")
import RevitServices
from RevitServices.Persistence import DocumentManager

# The inputs to this node will be stored as a list in the IN variables.


# Place your code below this line
uidoc = DocumentManager.Instance.CurrentUIApplication.ActiveUIDocument
doc = uidoc.Document

# Assign your output to the OUT variable.
OUT = [uidoc,doc]
# ----------------------------------------
lastItem = List.LastItem(list=python_script_4)

# group: UI Report
firstItem_2 = List.FirstItem(list=clean_2)
code_block_8 = CodeBlock { "No Circle Bank components has been found in the current view."; }
python_script_5 = Python(IN[0]=code_block_8, IN[1]=firstItem_2)  # IronPython2
# ---------- python_script_5.python (15 lines) ----------
# Load the Python Standard and DesignScript Libraries
import sys
import clr
clr.AddReference('ProtoGeometry')
from Autodesk.DesignScript.Geometry import *

# The inputs to this node will be stored as a list in the IN variables.
run = IN[0]
test = IN[1]

# Place your code below this line
if test == None:
	OUT = run
else:
	OUT = 0
# ----------------------------------------
UI_Report = HDLab_ZeroTouch.CircleBank.UI_Report(text=python_script_5)

python_script_6 = Python(IN[0]=lastItem, IN[1]=firstItem_2)  # IronPython2
# ---------- python_script_6.python (15 lines) ----------
# Load the Python Standard and DesignScript Libraries
import sys
import clr
clr.AddReference('ProtoGeometry')
from Autodesk.DesignScript.Geometry import *

# The inputs to this node will be stored as a list in the IN variables.
run = IN[0]
test = IN[1]

# Place your code below this line
if test == None:
	OUT = 0
else:
	OUT = run
# ----------------------------------------
UI_Switcher = HDLab_ZeroTouch.CircleBank.UI_Switcher(DB=end, doc=python_script_6)
python_script_7 = Python(IN[0]=UI_Switcher)  # IronPython2
# ---------- python_script_7.python (13 lines) ----------
# Load the Python Standard and DesignScript Libraries
import sys
import clr
clr.AddReference('ProtoGeometry')
from Autodesk.DesignScript.Geometry import *

# The inputs to this node will be stored as a list in the IN variables.
dataEnteringNode = IN[0]

# Place your code below this line

# Assign your output to the OUT variable.
OUT = dataEnteringNode
# ----------------------------------------
