# Dynamo graph script.dyn (Dynamo 2.12.0.5650)
# packages: Genius Loci 2022.1.5, Clockwork for Dynamo 2.x 2.3.0

current = Document.Current()
activeView = Document.ActiveView(document=current)

# group: Collect all CB components in the model
all_elements_in_active_view = ElementsInView()
elementType = Element.ElementType(element=all_elements_in_active_view)
boolean = BoolSelector(false)
clean = List.Clean(list=elementType, preserveIndices=boolean)
code_block = CodeBlock { "CB component ID"; }
parameterByName = Parameter.ParameterByName(element=clean, name=code_block)
value = Parameter.Value(parameter=parameterByName)
python_script = Python(IN[0]=value)  # IronPython2
# ---------- python_script.python (19 lines) ----------
# Load the Python Standard and DesignScript Libraries
import sys
import clr
clr.AddReference('ProtoGeometry')
from Autodesk.DesignScript.Geometry import *

# The inputs to this node will be stored as a list in the IN variables.
value = IN[0]
list = []

# Place your code below this line
for i in xrange(len(value)):
	if value[i] != "" and value[i] != None:
		list.append(True)
	else:
		list.append(False)

# Assign your output to the OUT variable.
OUT = list
# ----------------------------------------
filterByBoolMask = List.FilterByBoolMask(list=all_elements_in_active_view, mask=python_script)

# group: Check existing graphics
get_elements_overrides = Custom[Get Elements Overrides](view=activeView, element=all_elements_in_active_view)  # package Genius Loci; Get the overrides applied to the elements in the given View. Note : Prior to Revit 2019, the materials have only one surface pattern and one cut pattern.
python_script_2 = Python(IN[0]=get_elements_overrides.SurfaceForegroundPatternColor)  # IronPython2
# ---------- python_script_2.python (14 lines) ----------
# Load the Python Standard and DesignScript Libraries
import sys
import clr
clr.AddReference('ProtoGeometry')
from Autodesk.DesignScript.Geometry import *

# The inputs to this node will be stored as a list in the IN variables.
overrides = IN[0]

# Place your code below this line
if overrides[0] == None:
	OUT = False
else:
	OUT = True
# ----------------------------------------
python_script_3 = Python(IN[0]=python_script_2, IN[1]=filterByBoolMask.in)  # IronPython2
# ---------- python_script_3.python (15 lines) ----------
# Load the Python Standard and DesignScript Libraries
import sys
import clr
clr.AddReference('ProtoGeometry')
from Autodesk.DesignScript.Geometry import *

# The inputs to this node will be stored as a list in the IN variables.
bool = IN[0]
elements = IN[1]

# Place your code below this line
if bool == False:
	OUT = [elements, None]
else:
	OUT = [None, elements]
# ----------------------------------------
python_script_4 = Python(IN[0]=python_script_2, IN[1]=filterByBoolMask.out)  # IronPython2; same code as python_script_3

lastItem = List.LastItem(list=python_script_3)
view_resetelementoverrides = Custom[View ResetElementOverrides](view=activeView, element=lastItem)  # package Genius Loci; Removes all Graphics overrides for an element in a given view.
firstItem = List.FirstItem(list=python_script_3)
code_block_2 = CodeBlock { null; }
if_ = RefactoredIf(test=python_script_2, true=code_block_2, false=all_elements_in_active_view)

# group: Other components graphics
fill_patterns = FillPatterns("<Solid fill>")
color_palette = ColorPalette({R: 240, G: 248, B: 255, A: 255})
code_block_3 = CodeBlock { 60; }
boolean_2 = BoolSelector(true)
create_overridegraphicsettings = Custom[Create OverrideGraphicSettings](SurfaceForegroundPattern=fill_patterns, SurfaceForegroundPatternColor=color_palette, SurfaceBackgroundPattern=fill_patterns, SurfaceBackgroundColor=color_palette, Transparency=code_block_3, Halftone=boolean_2)  # package Genius Loci; Create a OverrideGraphicSettings (All graphic inputs are optional). Unlike the OOTB OverrideGraphicSettings.ByProperties node, the Foreground and background patterns are available. Note : Prior to Revit 2019, the materials have only one surface pattern and one cut pattern.

view_setelementoverrides = Custom[View SetElementOverrides](view=activeView, elements=if_, overrides=create_overridegraphicsettings)  # package Genius Loci; Overrides element graphics settings in the given view. For use with the Create OverrideGraphicSettings node. Can also be used to hide or unhide elements.
passthrough = Custom[Passthrough](passThrough=firstItem, waitFor=view_setelementoverrides)  # package Clockwork for Dynamo 2.x; Forces a sequential order of execution. The node wired into the output of the Passthrough node will be executed *after* the node wired into the waitFor input (e.g. important for some Revit operations). The value of the passThrough input will be passed on to the node wired into the output port of the Passthrough node.

# group: CB components graphics
fill_patterns_2 = FillPatterns("<Solid fill>")
color_palette_2 = ColorPalette({R: 73, G: 87, B: 98, A: 255})
create_overridegraphicsettings_2 = Custom[Create OverrideGraphicSettings](SurfaceForegroundPattern=fill_patterns_2, SurfaceForegroundPatternColor=color_palette_2, SurfaceBackgroundPattern=fill_patterns_2, SurfaceBackgroundColor=color_palette_2)

view_setelementoverrides_2 = Custom[View SetElementOverrides](view=activeView, elements=passthrough, overrides=create_overridegraphicsettings_2)
python_script_5 = Python(IN[0]=filterByBoolMask.out, IN[1]=filterByBoolMask.in)  # IronPython2
# ---------- python_script_5.python (15 lines) ----------
# Load the Python Standard and DesignScript Libraries
import sys
import clr
clr.AddReference('ProtoGeometry')
from Autodesk.DesignScript.Geometry import *

# The inputs to this node will be stored as a list in the IN variables.
run = IN[0]
test = IN[1]

# Place your code below this line
if len(test) == 0:
	OUT = None
else:
	OUT = run
# ----------------------------------------
lastItem_2 = List.LastItem(list=python_script_4)
view_resetelementoverrides_2 = Custom[View ResetElementOverrides](view=activeView, element=lastItem_2)

# group: UI Report
code_block_4 = CodeBlock { "No Circle Bank components has been found in the current view."; }
python_script_6 = Python(IN[0]=code_block_4, IN[1]=filterByBoolMask.in)  # IronPython2
# ---------- python_script_6.python (15 lines) ----------
# Load the Python Standard and DesignScript Libraries
import sys
import clr
clr.AddReference('ProtoGeometry')
from Autodesk.DesignScript.Geometry import *

# The inputs to this node will be stored as a list in the IN variables.
run = IN[0]
test = IN[1]

# Place your code below this line
if len(test) == 0:
	OUT = run
else:
	OUT = 0
# ----------------------------------------
UI_Report = HDLab_ZeroTouch.CircleBank.UI_Report(text=python_script_6)
