# Dynamo graph script.dyn "LCACalculatorUpdate" (Dynamo 2.12.0.5650)
# packages: Clockwork for Dynamo 2.x 2.3.0

all_elements_in_active_view = ElementsInView()
getCategory = Element.GetCategory(element=all_elements_in_active_view)
string_from_object = FromObject(object=getCategory)
code_block = CodeBlock { "Curtain Wall Mullions"; "Walls - Curtain Wall Grids"; "Curtain Panels"; }
python_script = Python(IN[0]=string_from_object, IN[1]=code_block.out0, IN[2]=code_block.out1, IN[3]=code_block.out2)  # IronPython2
# ---------- python_script.python (20 lines) ----------
# Load the Python Standard and DesignScript Libraries
import sys
import clr
clr.AddReference('ProtoGeometry')
from Autodesk.DesignScript.Geometry import *

# The inputs to this node will be stored as a list in the IN variables.
elem = IN[0]
no1 = IN[1]
no2 = IN[2]
no3 = IN[3]

OUT=[]

# Place your code below this line
for i in xrange (len(elem)):
	if elem[i] == no1 or elem[i] == no2 or elem[i] == no3:
		OUT.append(False)
	else:
		OUT.append(True)
# ----------------------------------------
filterByBoolMask = List.FilterByBoolMask(list=all_elements_in_active_view, mask=python_script)
code_block_2 = CodeBlock { "Area"; }
getParameterValueByName = Element.GetParameterValueByName(element=filterByBoolMask.in, parameterName=code_block_2)
code_block_3 = CodeBlock { ""; }
eq = getParameterValueByName == code_block_3
filterByBoolMask_2 = List.FilterByBoolMask(list=filterByBoolMask.in, mask=eq)
elementType = Element.ElementType(element=filterByBoolMask_2.out)
uniqueItems = List.UniqueItems(list=elementType)
code_block_4 = CodeBlock { "Global Warming Potential"; }
code_block_5 = CodeBlock { "Construction Weight [kg/m2]"; }

# group: Check if the parameters already exist
parameters = Element.Parameters(element=uniqueItems)

name = Parameter.Name(parameter=parameters)

# group (continued): Check if the parameters already exist
python_script_2 = Python(IN[0]=name, IN[1]=code_block_4, IN[2]=code_block_5)  # IronPython2
# ---------- python_script_2.python (19 lines) ----------
import clr
clr.AddReference('ProtoGeometry')
from Autodesk.DesignScript.Geometry import *
#The inputs to this node will be stored as a list in the IN variables.
elementParameters=IN[0]
parameter=IN[1]
parameter1=IN[2]
x=[]

for i in xrange (len(elementParameters)):
	if parameter in elementParameters[i]:
		x.Add(1)
	else:
		x.Add(0)

if max(x)==1:
	OUT=None
else:
	OUT=[parameter,parameter1]
# ----------------------------------------

# group: Create instance parameters
string = StringInput("Circle Bank")
select_parameter_type = ParameterType("Number")
select_builtin_parameter_group = BuiltInParameterGroup("PG_GREEN_BUILDING")
boolean = BoolSelector(false)
getCategory_2 = Element.GetCategory(element=filterByBoolMask_2.out)
uniqueItems_2 = List.UniqueItems(list=getCategory_2)
createProjectParameter = Parameter.CreateProjectParameter(parameterName=python_script_2, groupName=string, type=select_parameter_type, group=select_builtin_parameter_group, instance=boolean, categoryList=uniqueItems_2)

file_path = Filename("..\..\Box\HD Lab\02 Projekter\0137 Circle Bank [Innovation Foundation]\05 Databases\LCA\05 LCA for Revit Extension\RevitExtensionLCAData20-04-2022-normalized.xlsx")
file_from_path = FileObject(path=file_path)
code_block_6 = CodeBlock { "Results for Lorenzo"; }
boolean_2 = BoolSelector(false)
importExcel = Data.ImportExcel(file=file_from_path, sheetName=code_block_6, showExcel=boolean_2)
python_script_3 = Python(IN[0]=importExcel)  # IronPython2
# ---------- python_script_3.python (15 lines) ----------
# Load the Python Standard and DesignScript Libraries
import sys
import clr
clr.AddReference('ProtoGeometry')
from Autodesk.DesignScript.Geometry import *

# The inputs to this node will be stored as a list in the IN variables.
lca = IN[0]

OUT=[]

# Place your code below this line
for i in xrange(len(lca)):
	if lca[i][0] == "Bygningsdel":
		OUT.append(i)
# ----------------------------------------
getItemAtIndex = List.GetItemAtIndex(list=importExcel, index=python_script_3)
code_block_7 = CodeBlock { 1; }
getItemAtIndex_2 = List.GetItemAtIndex(list=getItemAtIndex@L2, index=code_block_7)
getCategory_3 = Element.GetCategory(element=uniqueItems)
string_from_object_2 = FromObject(object=getCategory_3)
python_script_4 = Python(IN[0]=string_from_object_2)  # IronPython2
# ---------- python_script_4.python (24 lines) ----------
# Load the Python Standard and DesignScript Libraries
import sys
import clr
clr.AddReference('ProtoGeometry')
from Autodesk.DesignScript.Geometry import *

# The inputs to this node will be stored as a list in the IN variables.
categ = IN[0]

OUT = []

# Place your code below this line

for i in xrange(len(categ)):
	if categ[i] == "Walls":
		OUT.append("Ydervæg 1")
	elif categ[i] == "Floors":
		OUT.append("Etagedæk 1")
	elif categ[i] == "Windows":
		OUT.append("Vindue1")
	elif categ[i] == "Doors":
		OUT.append("Dør 1")
	elif categ[i] == "Roofs":
		OUT.append("Terrændek 3")
# ----------------------------------------
indexOf = List.IndexOf(list=getItemAtIndex_2, element=python_script_4)
getItemAtIndex_3 = List.GetItemAtIndex(list=getItemAtIndex, index=indexOf)
code_block_8 = CodeBlock { 4; 14; }
getItemAtIndex_4 = List.GetItemAtIndex(list=getItemAtIndex_3@L2, index=code_block_8.out0)
getItemAtIndex_5 = List.GetItemAtIndex(list=getItemAtIndex_3@L2, index=code_block_8.out1)

# group: Set parameters value
passthrough = Custom[Passthrough](passThrough=uniqueItems, waitFor=createProjectParameter)  # package Clockwork for Dynamo 2.x; Forces a sequential order of execution. The node wired into the output of the Passthrough node will be executed *after* the node wired into the waitFor input (e.g. important for some Revit operations). The value of the passThrough input will be passed on to the node wired into the output port of the Passthrough node.
setParameterByName = Element.SetParameterByName(element=passthrough, parameterName=code_block_4, value=getItemAtIndex_4)
setParameterByName_2 = Element.SetParameterByName(element=passthrough, parameterName=code_block_5, value=getItemAtIndex_5)
