# Dynamo graph script.dyn (Dynamo 2.12.0.5650)
# packages: Genius Loci 2022.1.5

all_elements_in_active_view = ElementsInView()
elementType = Element.ElementType(element=all_elements_in_active_view)
code_block = CodeBlock { "CB component ID"; }
parameterByName = Parameter.ParameterByName(element=elementType, name=code_block)
value = Parameter.Value(parameter=parameterByName)
python_script = Python(IN[0]=value)  # IronPython2
# ---------- python_script.python (17 lines) ----------
# Load the Python Standard and DesignScript Libraries
import sys
import clr
clr.AddReference('ProtoGeometry')
from Autodesk.DesignScript.Geometry import *

# The inputs to this node will be stored as a list in the IN variables.
value = IN[0]
list = []

# Place your code below this line
for i in xrange(len(value)):
	if value[i] != 0 and value[i] != None:
		list.append(i)

# Assign your output to the OUT variable.
OUT = list
# ----------------------------------------
getItemAtIndex = List.GetItemAtIndex(list=elementType, index=python_script)
identity = Object.Identity()  # unwired: object
groupByFunction = List.GroupByFunction(list=getItemAtIndex, groupFunction=identity)
count = List.Count(list=groupByFunction@L2)
code_block_2 = CodeBlock { ""; }
eq = value == code_block_2
filterByBoolMask = List.FilterByBoolMask(list=elementType, mask=eq)
identity_2 = Object.Identity()  # unwired: object
groupByFunction_2 = List.GroupByFunction(list=filterByBoolMask.in, groupFunction=identity_2)
count_2 = List.Count(list=groupByFunction_2@L2)
firstItem = List.FirstItem(list=groupByFunction@L2)
all_elements_of_type = Custom[All Elements of Type+](type=firstItem)  # package Genius Loci; Get the instances of the given type. Works with ElementType, FamilyType, ViewFamilyType, Wall/Floor/Roof/CeilingType, GroupType, FilledRegionType and TextNoteType.
code_block_3 = CodeBlock { null; }
eq_2 = all_elements_of_type == code_block_3
firstItem_2 = List.FirstItem(list=groupByFunction_2@L2)
code_block_4 = CodeBlock { "CB Revit component ID"; }
parameterByName_2 = Parameter.ParameterByName(element=firstItem_2, name=code_block_4)
value_2 = Parameter.Value(parameter=parameterByName_2)
code_block_5 = CodeBlock { 0; }
eq_3 = value_2 == code_block_5
filterByBoolMask_2 = List.FilterByBoolMask(list=firstItem_2, mask=eq_3)
all_elements_of_type_2 = Custom[All Elements of Type+](type=filterByBoolMask_2.out)
id = Element.Id(element=all_elements_of_type_2)
filterByBoolMask_3 = List.FilterByBoolMask(list=value_2, mask=eq_3)
python_script_2 = Python()  # IronPython2; unwired: IN[0]
# ---------- python_script_2.python (18 lines) ----------
# Load the Python Standard and DesignScript Libraries
import sys
import clr
clr.AddReference('ProtoGeometry')
from Autodesk.DesignScript.Geometry import *
clr.AddReference("RevitServices")
import RevitServices
from RevitServices.Persistence import DocumentManager

# The inputs to this node will be stored as a list in the IN variables.


# Place your code below this line
uidoc = DocumentManager.Instance.CurrentUIApplication.ActiveUIDocument
doc = uidoc.Document

# Assign your output to the OUT variable.
OUT = [uidoc,doc]
# ----------------------------------------
lastItem = List.LastItem(list=python_script_2)
UI_ReplaceType = ReadOnlineDatabase.ReadOnlineDatabase.UI_ReplaceType(elements=id, typeid=filterByBoolMask_3.out, doc=lastItem)
id_2 = Element.Id(element=all_elements_of_type)
code_block_6 = CodeBlock { "Original Revit component ID"; }
parameterByName_3 = Parameter.ParameterByName(element=firstItem, name=code_block_6)
value_3 = Parameter.Value(parameter=parameterByName_3)
UI_ReplaceType_2 = ReadOnlineDatabase.ReadOnlineDatabase.UI_ReplaceType(elements=id_2, typeid=value_3, doc=lastItem)
if_ = RefactoredIf(test=eq_2, true=UI_ReplaceType, false=UI_ReplaceType_2)
