# Dynamo graph script.dyn (Dynamo 2.12.0.5650)

# group: Reading JSON
readDatabase = ReadOnlineDatabase.ReadOnlineDatabase.ReadDatabase()
parseJSON = Data.ParseJSON(json=readDatabase)
values = DesignScript.Builtin.Dictionary.Values(dictionary=parseJSON)
values_2 = DesignScript.Builtin.Dictionary.Values(dictionary=values)

code_block = CodeBlock { 1; }
getItemAtIndex = List.GetItemAtIndex(list=values_2, index=code_block)

# group: Collect all CB components in the model
all_elements_in_active_view = ElementsInView()
elementType = Element.ElementType(element=all_elements_in_active_view)
boolean = BoolSelector(false)
clean = List.Clean(list=elementType, preserveIndices=boolean)
code_block_2 = CodeBlock { "CB component ID"; }
parameterByName = Parameter.ParameterByName(element=clean, name=code_block_2)
value = Parameter.Value(parameter=parameterByName)
python_script = Python(IN[0]=value)  # IronPython2
# ---------- python_script.python (17 lines) ----------
# Load the Python Standard and DesignScript Libraries
import sys
import clr
clr.AddReference('ProtoGeometry')
from Autodesk.DesignScript.Geometry import *

# The inputs to this node will be stored as a list in the IN variables.
value = IN[0]
list = []

# Place your code below this line
for i in xrange(len(value)):
	if value[i] != "" and value[i] != None:
		list.append(i)

# Assign your output to the OUT variable.
OUT = list
# ----------------------------------------
getItemAtIndex_2 = List.GetItemAtIndex(list=clean, index=python_script)
identity = Object.Identity()  # unwired: object
groupByFunction = List.GroupByFunction(list=getItemAtIndex_2, groupFunction=identity)
firstItem = List.FirstItem(list=groupByFunction@L2)

# group: Find correspondent components on CB database
code_block_3 = CodeBlock { "materialid"; }
valueAtKey = DesignScript.Builtin.Dictionary.ValueAtKey(dictionary=getItemAtIndex, key=code_block_3)
code_block_4 = CodeBlock { "CB component ID"; }
parameterByName_2 = Parameter.ParameterByName(element=firstItem, name=code_block_4)
value_2 = Parameter.Value(parameter=parameterByName_2)
indexOf = List.IndexOf(list=valueAtKey, element=value_2)
getItemAtIndex_3 = List.GetItemAtIndex(list=getItemAtIndex, index=indexOf)

# group: Data from CB database
code_block_5 = CodeBlock { "title"; "gwpreused"; "costreused"; "reserved"; "gwpnew"; "costnew"; }
valueAtKey_2 = DesignScript.Builtin.Dictionary.ValueAtKey(dictionary=getItemAtIndex_3, key=code_block_5.out0)
valueAtKey_3 = DesignScript.Builtin.Dictionary.ValueAtKey(dictionary=getItemAtIndex_3, key=code_block_5.out3)
valueAtKey_4 = DesignScript.Builtin.Dictionary.ValueAtKey(dictionary=getItemAtIndex_3, key=code_block_5.out4)
valueAtKey_5 = DesignScript.Builtin.Dictionary.ValueAtKey(dictionary=getItemAtIndex_3, key=code_block_5.out1)
# note: These last 2 should come from the original component instead
valueAtKey_6 = DesignScript.Builtin.Dictionary.ValueAtKey(dictionary=getItemAtIndex_3, key=code_block_5.out5)
valueAtKey_7 = DesignScript.Builtin.Dictionary.ValueAtKey(dictionary=getItemAtIndex_3, key=code_block_5.out2)

getCategory = Element.GetCategory(element=firstItem)
count = List.Count(list=groupByFunction@L2)

# group: Get original Revit component (for comparison)
code_block_6 = CodeBlock { "Original Revit component ID"; }
parameterByName_3 = Parameter.ParameterByName(element=firstItem, name=code_block_6)
value_3 = Parameter.Value(parameter=parameterByName_3)
code_block_7 = CodeBlock(id=value_3) { Revit.Elements.ElementSelector.ByElementId(id); }

family = FamilyType.Family(familyType=code_block_7)
name = Family.Name(family=family)
name_2 = Element.Name(element=code_block_7)
python_script_2 = Python(IN[0]=name, IN[1]=name_2)  # IronPython2
# ---------- python_script_2.python (21 lines) ----------
# Load the Python Standard and DesignScript Libraries
import sys
import clr
clr.AddReference('ProtoGeometry')
from Autodesk.DesignScript.Geometry import *

# The inputs to this node will be stored as a list in the IN variable
families= IN[0]
types = IN[1]

names = []

# Place your code below this line
for i in xrange (len(families)):
	if families[i] != None:
		names.append(families[i]+" ("+types[i]+")")
	else:
		names.append("")

# Assign your output to the OUT variable.
OUT = names
# ----------------------------------------

# group: Group by category
groupByKey = List.GroupByKey(list=valueAtKey_2, keys=getCategory)
groupByKey_2 = List.GroupByKey(list=valueAtKey_3, keys=getCategory)
groupByKey_3 = List.GroupByKey(list=valueAtKey_4, keys=getCategory)
groupByKey_4 = List.GroupByKey(list=valueAtKey_5, keys=getCategory)
groupByKey_5 = List.GroupByKey(list=count, keys=getCategory)
groupByKey_6 = List.GroupByKey(list=valueAtKey_6, keys=getCategory)
groupByKey_7 = List.GroupByKey(list=valueAtKey_7, keys=getCategory)
groupByKey_8 = List.GroupByKey(list=python_script_2, keys=getCategory)

# group: Calculations
sub = groupByKey_3.groups - groupByKey_4.groups
mul = sub * groupByKey_5.groups
# note: GWP savings for each category
sum = Math.Sum(values=mul)
# note: Total GWP savings
sum_2 = Math.Sum(values=sum)
div = sum / sum_2
code_block_8 = CodeBlock { 100; }
# note: Contribution of each category to total GWP savings
mul_2 = div * code_block_8
sub_2 = groupByKey_6.groups - groupByKey_7.groups
mul_3 = sub_2 * groupByKey_5.groups
# note: Costs savings for each category
sum_3 = Math.Sum(values=mul_3)
# note: Total Costs savings
sum_4 = Math.Sum(values=sum_3)
div_2 = sum_3 / sum_4
# note: Contribution of each category to total Costs savings
mul_4 = div_2 * code_block_8
mul_5 = groupByKey_3.groups * groupByKey_5.groups
sum_5 = Math.Sum(values=mul_5)
div_3 = sum / sum_5
code_block_9 = CodeBlock { 100; }
# note: % GWP savings for each category
mul_6 = div_3 * code_block_9
mul_7 = groupByKey_6.groups * groupByKey_5.groups
sum_6 = Math.Sum(values=mul_7)
div_4 = sum_3 / sum_6
# note: % Costs savings for each category
mul_8 = div_4 * code_block_9

name_3 = Category.Name(category=groupByKey_8.uniqueKeys)
code_block_10 = CodeBlock { ["#FF748089","#FFC1A698"]; }
sum_7 = Math.Sum(values=groupByKey_5.groups)
UI_ProjectOverview = ReadOnlineDatabase.ReadOnlineDatabase.UI_ProjectOverview(categories=name_3, gwpsavings=mul_6, costssavings=mul_8, totgwp=sum_2, totcosts=sum_4, contribgwp=sum, contribcosts=sum_3, colors=code_block_10, quantity=sum_7)

# group: UI Report
code_block_11 = CodeBlock { "No Circle Bank components has been found in the current view."; }
firstItem_2 = List.FirstItem(list=firstItem)
python_script_3 = Python(IN[0]=code_block_11, IN[1]=firstItem_2)  # IronPython2
# ---------- python_script_3.python (15 lines) ----------
# Load the Python Standard and DesignScript Libraries
import sys
import clr
clr.AddReference('ProtoGeometry')
from Autodesk.DesignScript.Geometry import *

# The inputs to this node will be stored as a list in the IN variables.
run = IN[0]
test = IN[1]

# Place your code below this line
if test == None:
	OUT = run
else:
	OUT = 0
# ----------------------------------------
UI_Report = ReadOnlineDatabase.ReadOnlineDatabase.UI_Report(text=python_script_3)
