# Dynamo graph script.dyn (Dynamo 2.12.0.5650)
# packages: Genius Loci 2022.1.5

# group: Reading JSON
readDatabase = HDLab_ZeroTouch.CircleBank.ReadDatabase()
parseJSON = Data.ParseJSON(json=readDatabase)
code_block = CodeBlock { "materialtypes"; }
valueAtKey = DesignScript.Builtin.Dictionary.ValueAtKey(dictionary=parseJSON, key=code_block)
values = DesignScript.Builtin.Dictionary.Values(dictionary=valueAtKey)

# group: Collect all CB components in the model
all_elements_in_active_view = ElementsInView()
elementType = Element.ElementType(element=all_elements_in_active_view)
boolean = BoolSelector(false)
clean = List.Clean(list=elementType, preserveIndices=boolean)
code_block_2 = CodeBlock { "CB component ID"; }
parameterByName = Parameter.ParameterByName(element=clean, name=code_block_2)
value = Parameter.Value(parameter=parameterByName)
python_script = Python(IN[0]=value)  # IronPython2
# ---------- python_script.python (17 lines) ----------
# Load the Python Standard and DesignScript Libraries
import sys
import clr
clr.AddReference('ProtoGeometry')
from Autodesk.DesignScript.Geometry import *

# The inputs to this node will be stored as a list in the IN variables.
value = IN[0]
list = []

# Place your code below this line
for i in xrange(len(value)):
	if value[i] != "" and value[i] != None:
		list.append(i)

# Assign your output to the OUT variable.
OUT = list
# ----------------------------------------
getItemAtIndex = List.GetItemAtIndex(list=clean, index=python_script)
identity = Object.Identity()  # unwired: object
groupByFunction = List.GroupByFunction(list=getItemAtIndex, groupFunction=identity)
firstItem = List.FirstItem(list=groupByFunction@L2)

# group: Find correspondent components on CB database
code_block_3 = CodeBlock { "materialid"; }
valueAtKey_2 = DesignScript.Builtin.Dictionary.ValueAtKey(dictionary=values, key=code_block_3)
code_block_4 = CodeBlock { "CB component ID"; }
parameterByName_2 = Parameter.ParameterByName(element=firstItem, name=code_block_4)
value_2 = Parameter.Value(parameter=parameterByName_2)
indexOf = List.IndexOf(list=valueAtKey_2, element=value_2)
getItemAtIndex_2 = List.GetItemAtIndex(list=values, index=indexOf)

# group: Data from CB database
code_block_5 = CodeBlock { "title"; "gwpreused"; "costreused"; "reserved"; "gwpnew"; "costnew"; }
valueAtKey_3 = DesignScript.Builtin.Dictionary.ValueAtKey(dictionary=getItemAtIndex_2, key=code_block_5.out3)
valueAtKey_4 = DesignScript.Builtin.Dictionary.ValueAtKey(dictionary=getItemAtIndex_2, key=code_block_5.out4)
valueAtKey_5 = DesignScript.Builtin.Dictionary.ValueAtKey(dictionary=getItemAtIndex_2, key=code_block_5.out1)
# note: These last 2 should come from the original component instead
valueAtKey_6 = DesignScript.Builtin.Dictionary.ValueAtKey(dictionary=getItemAtIndex_2, key=code_block_5.out5)
valueAtKey_7 = DesignScript.Builtin.Dictionary.ValueAtKey(dictionary=getItemAtIndex_2, key=code_block_5.out2)
valueAtKey_8 = DesignScript.Builtin.Dictionary.ValueAtKey(dictionary=getItemAtIndex_2, key=code_block_5.out0)

getCategory = Element.GetCategory(element=firstItem)

# group: Get original Revit component (for comparison)
code_block_6 = CodeBlock { "Original Revit component ID"; }
parameterByName_3 = Parameter.ParameterByName(element=firstItem, name=code_block_6)
value_3 = Parameter.Value(parameter=parameterByName_3)
code_block_7 = CodeBlock(id=value_3) { Revit.Elements.ElementSelector.ByElementId(id); }

family = FamilyType.Family(familyType=code_block_7)
name = Family.Name(family=family)
name_2 = Element.Name(element=code_block_7)
python_script_2 = Python(IN[0]=name, IN[1]=name_2)  # IronPython2
# ---------- python_script_2.python (21 lines) ----------
# Load the Python Standard and DesignScript Libraries
import sys
import clr
clr.AddReference('ProtoGeometry')
from Autodesk.DesignScript.Geometry import *

# The inputs to this node will be stored as a list in the IN variable
families= IN[0]
types = IN[1]

names = []

# Place your code below this line
for i in xrange (len(families)):
	if families[i] != None:
		names.append(families[i]+" ("+types[i]+")")
	else:
		names.append("")

# Assign your output to the OUT variable.
OUT = names
# ----------------------------------------
count = List.Count(list=groupByFunction@L2)

# group: Group by category
groupByKey = List.GroupByKey(list=valueAtKey_3, keys=getCategory)
groupByKey_2 = List.GroupByKey(list=python_script_2, keys=getCategory)
groupByKey_3 = List.GroupByKey(list=valueAtKey_4, keys=getCategory)
groupByKey_4 = List.GroupByKey(list=valueAtKey_5, keys=getCategory)
groupByKey_5 = List.GroupByKey(list=count, keys=getCategory)
groupByKey_6 = List.GroupByKey(list=valueAtKey_6, keys=getCategory)
groupByKey_7 = List.GroupByKey(list=valueAtKey_7, keys=getCategory)
groupByKey_8 = List.GroupByKey(list=valueAtKey_8, keys=getCategory)

# group: Calculations
sub = groupByKey_3.groups - groupByKey_4.groups
mul = sub * groupByKey_5.groups
# note: GWP savings for each category
sum = Math.Sum(values=mul)
# note: Total GWP savings
sum_2 = Math.Sum(values=sum)
div = sum / sum_2
code_block_8 = CodeBlock { 100; }
# note: Contribution of each category to total GWP savings
mul_2 = div * code_block_8
sub_2 = groupByKey_6.groups - groupByKey_7.groups
mul_3 = sub_2 * groupByKey_5.groups
# note: Costs savings for each category
sum_3 = Math.Sum(values=mul_3)
# note: Total Costs savings
sum_4 = Math.Sum(values=sum_3)
div_2 = sum_3 / sum_4
# note: Contribution of each category to total Costs savings
mul_4 = div_2 * code_block_8
mul_5 = groupByKey_3.groups * groupByKey_5.groups
sum_5 = Math.Sum(values=mul_5)
div_3 = sum / sum_5
code_block_9 = CodeBlock { 100; }
# note: % GWP savings for each category
mul_6 = div_3 * code_block_9
mul_7 = groupByKey_6.groups * groupByKey_5.groups
sum_6 = Math.Sum(values=mul_7)
div_4 = sum_3 / sum_6
# note: % Costs savings for each category
mul_8 = div_4 * code_block_9

# group: Comparison by count
count_2 = List.Count(list=python_script)
count_3 = List.Count(list=all_elements_in_active_view)
code_block_10 = CodeBlock(x=count_2, y=count_3) { x/y*100; }

# group: UI Report
code_block_11 = CodeBlock { "No Circle Bank component has been found in the current view."; }
firstItem_2 = List.FirstItem(list=firstItem)
python_script_3 = Python(IN[0]=code_block_11, IN[1]=firstItem_2)  # IronPython2
# ---------- python_script_3.python (15 lines) ----------
# Load the Python Standard and DesignScript Libraries
import sys
import clr
clr.AddReference('ProtoGeometry')
from Autodesk.DesignScript.Geometry import *

# The inputs to this node will be stored as a list in the IN variables.
run = IN[0]
test = IN[1]

# Place your code below this line
if test == None:
	OUT = run
else:
	OUT = 0
# ----------------------------------------
UI_Report = HDLab_ZeroTouch.CircleBank.UI_Report(text=python_script_3)

code_block_12 = CodeBlock { "Area"; }
getParameterValueByName = Element.GetParameterValueByName(element=all_elements_in_active_view, parameterName=code_block_12)
code_block_13 = CodeBlock { "Global Warming Potential"; }
getParameterValueByName_2 = Element.GetParameterValueByName(element=elementType, parameterName=code_block_13)
mul_9 = getParameterValueByName * getParameterValueByName_2
isNull = Object.IsNull(object=mul_9)
filterByBoolMask = List.FilterByBoolMask(list=all_elements_in_active_view, mask=isNull)

# group: UI Report
code_block_14 = CodeBlock { "Global Warming Potential values have not yet being assigned to the project components."; }
python_script_4 = Python(IN[0]=code_block_14, IN[1]=filterByBoolMask.out)  # IronPython2
# ---------- python_script_4.python (15 lines) ----------
# Load the Python Standard and DesignScript Libraries
import sys
import clr
clr.AddReference('ProtoGeometry')
from Autodesk.DesignScript.Geometry import *

# The inputs to this node will be stored as a list in the IN variables.
run = IN[0]
test = IN[1]

# Place your code below this line
if len(test) == 0:
	OUT = run
else:
	OUT = 0
# ----------------------------------------
python_script_5 = Python(IN[0]=python_script_4, IN[1]=python_script_3)  # IronPython2
# ---------- python_script_5.python (15 lines) ----------
# Load the Python Standard and DesignScript Libraries
import sys
import clr
clr.AddReference('ProtoGeometry')
from Autodesk.DesignScript.Geometry import *

# The inputs to this node will be stored as a list in the IN variables.
run = IN[0]
test = IN[1]

# Place your code below this line
if test == 0:
	OUT = run
else:
	OUT = 0
# ----------------------------------------
UI_Report_2 = HDLab_ZeroTouch.CircleBank.UI_Report(text=python_script_5)

name_3 = Category.Name(category=groupByKey_8.uniqueKeys)
all_elements_of_type = Custom[All Elements of Type+](type=firstItem)  # package Genius Loci; Get the instances of the given type. Works with ElementType, FamilyType, ViewFamilyType, Wall/Floor/Roof/CeilingType, GroupType, FilledRegionType and TextNoteType.
code_block_15 = CodeBlock { "Area"; }
getParameterValueByName_3 = Element.GetParameterValueByName(element=all_elements_of_type, parameterName=code_block_15)
sum_7 = Math.Sum(values=getParameterValueByName_3)
code_block_16 = CodeBlock { "Global Warming Potential"; }
getParameterValueByName_4 = Element.GetParameterValueByName(element=code_block_7, parameterName=code_block_16)
mul_10 = sum_7 * getParameterValueByName_4
getParameterValueByName_5 = Element.GetParameterValueByName(element=firstItem, parameterName=code_block_16)
mul_11 = sum_7 * getParameterValueByName_5
sub_3 = mul_10 - mul_11
filterByBoolMask_2 = List.FilterByBoolMask(list=mul_9, mask=isNull)
getCategory_2 = Element.GetCategory(element=filterByBoolMask.out)
groupByKey_9 = List.GroupByKey(list=filterByBoolMask_2.out, keys=getCategory_2)
# note: GWP by category
sum_8 = Math.Sum(values=groupByKey_9.groups)
getCategory_3 = Element.GetCategory(element=firstItem)
indexOf_2 = List.IndexOf(list=groupByKey_9.uniqueKeys, element=getCategory_3)
getItemAtIndex_3 = List.GetItemAtIndex(list=sum_8, index=indexOf_2)
add = getItemAtIndex_3 + sub_3
div_5 = sub_3 / add
code_block_17 = CodeBlock { 100; }
mul_12 = div_5 * code_block_17
floor = Math.Floor(number=sub_3)
# note: Total GWP savings
sum_9 = Math.Sum(values=floor)
sum_10 = Math.Sum(values=groupByKey_5.groups)
# note: Total project GWP
sum_11 = Math.Sum(values=sum_8)
div_6 = sum_9 / sum_11
code_block_18 = CodeBlock { 100; }
mul_13 = div_6 * code_block_18
code_block_19 = CodeBlock(x=mul_8) { x[0]/10; }

# group: Compare weight
code_block_20 = CodeBlock { "Construction Weight [kg/m2]"; }
getParameterValueByName_6 = Element.GetParameterValueByName(element=elementType, parameterName=code_block_20)
mul_14 = getParameterValueByName * getParameterValueByName_6
isNull_2 = Object.IsNull(object=mul_14)
filterByBoolMask_3 = List.FilterByBoolMask(list=mul_14, mask=isNull_2)
filterByBoolMask_4 = List.FilterByBoolMask(list=all_elements_in_active_view, mask=isNull_2)
getItemAtIndex_4 = List.GetItemAtIndex(list=all_elements_in_active_view, index=python_script)
indexOf_3 = List.IndexOf(list=filterByBoolMask_4.out, element=getItemAtIndex_4)
getItemAtIndex_5 = List.GetItemAtIndex(list=filterByBoolMask_3.out, index=indexOf_3)
sum_12 = Math.Sum(values=getItemAtIndex_5)
removeItemAtIndex = List.RemoveItemAtIndex(list=filterByBoolMask_3.out, indices=indexOf_3)
sum_13 = Math.Sum(values=removeItemAtIndex)
add_2 = sum_12 + sum_13
div_7 = sum_12 / add_2
code_block_21 = CodeBlock { 100; }
mul_15 = div_7 * code_block_21

# note: Life expectancy
code_block_22 = CodeBlock { 50; }
div_8 = sum_11 / code_block_22
getCategory_4 = Element.GetCategory(element=all_elements_in_active_view)
groupByKey_10 = List.GroupByKey(list=getParameterValueByName, keys=getCategory_4)
categories = Categories("OST_Floors")
indexOf_4 = List.IndexOf(list=groupByKey_10.uniqueKeys, element=categories)
getItemAtIndex_6 = List.GetItemAtIndex(list=groupByKey_10.groups, index=indexOf_4)
sum_14 = Math.Sum(values=getItemAtIndex_6)
# note: Total GWP per m2 per year
div_9 = div_8 / sum_14
UI_ProjectOverview_Updated = HDLab_ZeroTouch.CircleBank.UI_ProjectOverview_Updated(categories=name_3, gwpsavings=mul_12, costssavings=mul_8, totgwp=sum_9, totcosts=sum_4, contribgwp=floor, contribcosts=sum_3, quantity=sum_10, totgwpsavings=mul_13, totcostsavings=code_block_19, thirtyseventy=mul_15, co2m2y=div_9)
