# Dynamo graph script.dyn (Dynamo 2.12.0.5650)

# group: Reading JSON
readDatabase = HDLab_ZeroTouch.CircleBank.ReadDatabase()
parseJSON = Data.ParseJSON(json=readDatabase)
code_block = CodeBlock { "materialtypes"; }
valueAtKey = DesignScript.Builtin.Dictionary.ValueAtKey(dictionary=parseJSON, key=code_block)
values = DesignScript.Builtin.Dictionary.Values(dictionary=valueAtKey)

# group: Collect elements of chosen categories
code_block_2 = CodeBlock { ["Windows","Doors", "Walls", "Floors", "Ceilings", "Roofs"]; }
byName = Category.ByName(name=code_block_2)
all_elements_of_category = ElementsOfCategory(Category=byName)
flatten = List.Flatten(list=all_elements_of_category)

# group: Collect all CB components in the model
elementType = Element.ElementType(element=flatten)
boolean = BoolSelector(false)
clean = List.Clean(list=elementType, preserveIndices=boolean)
code_block_3 = CodeBlock { "CB component ID"; }
parameterByName = Parameter.ParameterByName(element=clean, name=code_block_3)
value = Parameter.Value(parameter=parameterByName)
python_script = Python(IN[0]=value)  # IronPython2
# ---------- python_script.python (17 lines) ----------
# Load the Python Standard and DesignScript Libraries
import sys
import clr
clr.AddReference('ProtoGeometry')
from Autodesk.DesignScript.Geometry import *

# The inputs to this node will be stored as a list in the IN variables.
value = IN[0]
list = []

# Place your code below this line
for i in xrange(len(value)):
	if value[i] != "" and value[i] != None:
		list.append(i)

# Assign your output to the OUT variable.
OUT = list
# ----------------------------------------
getItemAtIndex = List.GetItemAtIndex(list=clean, index=python_script)
identity = Object.Identity()  # unwired: object
groupByFunction = List.GroupByFunction(list=getItemAtIndex, groupFunction=identity)
firstItem = List.FirstItem(list=groupByFunction@L2)

# group: Find correspondent components on CB database
code_block_4 = CodeBlock { "materialid"; }
valueAtKey_2 = DesignScript.Builtin.Dictionary.ValueAtKey(dictionary=values, key=code_block_4)
code_block_5 = CodeBlock { "CB component ID"; }
parameterByName_2 = Parameter.ParameterByName(element=firstItem, name=code_block_5)
value_2 = Parameter.Value(parameter=parameterByName_2)
indexOf = List.IndexOf(list=valueAtKey_2, element=value_2)
getItemAtIndex_2 = List.GetItemAtIndex(list=values, index=indexOf)

# group: Data from CB database
code_block_6 = CodeBlock { "title"; "gwpreused"; "costreused"; "reserved"; "gwpnew"; "costnew"; }
valueAtKey_3 = DesignScript.Builtin.Dictionary.ValueAtKey(dictionary=getItemAtIndex_2, key=code_block_6.out3)
valueAtKey_4 = DesignScript.Builtin.Dictionary.ValueAtKey(dictionary=getItemAtIndex_2, key=code_block_6.out4)
valueAtKey_5 = DesignScript.Builtin.Dictionary.ValueAtKey(dictionary=getItemAtIndex_2, key=code_block_6.out1)
# note: These last 2 should come from the original component instead
valueAtKey_6 = DesignScript.Builtin.Dictionary.ValueAtKey(dictionary=getItemAtIndex_2, key=code_block_6.out5)
valueAtKey_7 = DesignScript.Builtin.Dictionary.ValueAtKey(dictionary=getItemAtIndex_2, key=code_block_6.out2)
valueAtKey_8 = DesignScript.Builtin.Dictionary.ValueAtKey(dictionary=getItemAtIndex_2, key=code_block_6.out0)

getCategory = Element.GetCategory(element=firstItem)
count = List.Count(list=groupByFunction@L2)
code_block_7 = CodeBlock { ["#FF748089","#FFC1A698"]; }

# group: UI Report
code_block_8 = CodeBlock { "No Circle Bank component has been found in the current view."; }
firstItem_2 = List.FirstItem(list=firstItem)
python_script_2 = Python(IN[0]=code_block_8, IN[1]=firstItem_2)  # IronPython2
# ---------- python_script_2.python (15 lines) ----------
# Load the Python Standard and DesignScript Libraries
import sys
import clr
clr.AddReference('ProtoGeometry')
from Autodesk.DesignScript.Geometry import *

# The inputs to this node will be stored as a list in the IN variables.
run = IN[0]
test = IN[1]

# Place your code below this line
if test == None:
	OUT = run
else:
	OUT = 0
# ----------------------------------------
UI_Report = HDLab_ZeroTouch.CircleBank.UI_Report(text=python_script_2)

# group: Get original Revit component (for comparison)
code_block_9 = CodeBlock { "Original Revit component ID"; }
parameterByName_3 = Parameter.ParameterByName(element=firstItem, name=code_block_9)
value_3 = Parameter.Value(parameter=parameterByName_3)
code_block_10 = CodeBlock(id=value_3) { Revit.Elements.ElementSelector.ByElementId(id); }

family = FamilyType.Family(familyType=code_block_10)
name = Family.Name(family=family)
name_2 = Element.Name(element=code_block_10)
python_script_3 = Python(IN[0]=name, IN[1]=name_2)  # IronPython2
# ---------- python_script_3.python (21 lines) ----------
# Load the Python Standard and DesignScript Libraries
import sys
import clr
clr.AddReference('ProtoGeometry')
from Autodesk.DesignScript.Geometry import *

# The inputs to this node will be stored as a list in the IN variable
families= IN[0]
types = IN[1]

names = []

# Place your code below this line
for i in xrange (len(families)):
	if families[i] != None:
		names.append(families[i]+" ("+types[i]+")")
	else:
		names.append("")

# Assign your output to the OUT variable.
OUT = names
# ----------------------------------------

# group: Group by category
groupByKey = List.GroupByKey(list=valueAtKey_3, keys=getCategory)
groupByKey_2 = List.GroupByKey(list=valueAtKey_4, keys=getCategory)
groupByKey_3 = List.GroupByKey(list=valueAtKey_5, keys=getCategory)
groupByKey_4 = List.GroupByKey(list=count, keys=getCategory)
groupByKey_5 = List.GroupByKey(list=valueAtKey_6, keys=getCategory)
groupByKey_6 = List.GroupByKey(list=valueAtKey_7, keys=getCategory)
groupByKey_7 = List.GroupByKey(list=valueAtKey_8, keys=getCategory)
groupByKey_8 = List.GroupByKey(list=python_script_3, keys=getCategory)

# group: Calculations
sub = groupByKey_2.groups - groupByKey_3.groups
mul = sub * groupByKey_4.groups
# note: GWP savings for each category
sum = Math.Sum(values=mul)
# note: Total GWP savings
sum_2 = Math.Sum(values=sum)
div = sum / sum_2
code_block_11 = CodeBlock { 100; }
# note: Contribution of each category to total GWP savings
mul_2 = div * code_block_11
sub_2 = groupByKey_5.groups - groupByKey_6.groups
mul_3 = sub_2 * groupByKey_4.groups
# note: Costs savings for each category
sum_3 = Math.Sum(values=mul_3)
# note: Total Costs savings
sum_4 = Math.Sum(values=sum_3)
div_2 = sum_3 / sum_4
# note: Contribution of each category to total Costs savings
mul_4 = div_2 * code_block_11
mul_5 = groupByKey_5.groups * groupByKey_4.groups
sum_5 = Math.Sum(values=mul_5)
div_3 = sum_3 / sum_5
code_block_12 = CodeBlock { 100; }
# note: % Costs savings for each category
mul_6 = div_3 * code_block_12
mul_7 = groupByKey_2.groups * groupByKey_4.groups
sum_6 = Math.Sum(values=mul_7)
div_4 = sum / sum_6
# note: % GWP savings for each category
mul_8 = div_4 * code_block_12

name_3 = Category.Name(category=groupByKey_7.uniqueKeys)
python_script_4 = Python(IN[0]=groupByKey_8.groups)  # IronPython2
# ---------- python_script_4.python (14 lines) ----------
# Load the Python Standard and DesignScript Libraries
import sys
import clr
clr.AddReference('ProtoGeometry')
from Autodesk.DesignScript.Geometry import *

# The inputs to this node will be stored as a list in the IN variables.
orig = IN[0]

# Place your code below this line
if orig == None:
	OUT = ""
else:
	OUT = orig
# ----------------------------------------
UI_ShoppingCart = HDLab_ZeroTouch.CircleBank.UI_ShoppingCart(categories=name_3, nameCB=groupByKey_7.groups, nameOriginal=python_script_4, quantity=groupByKey_4.groups, price=groupByKey_6.groups)
