# Dynamo graph script.dyn (Dynamo 2.12.0.5650)
# packages: Clockwork for Dynamo 2.x 2.3.0

# group: Collect elements of chosen categories
code_block = CodeBlock { ["Windows","Doors", "Walls", "Floors", "Ceilings", "Roofs"]; }
byName = Category.ByName(name=code_block)
all_elements_of_category = ElementsOfCategory(Category=byName)
flatten = List.Flatten(list=all_elements_of_category)

getCategory = Element.GetCategory(element=flatten)
string_from_object = FromObject(object=getCategory)
code_block_2 = CodeBlock { "Curtain Wall Mullions"; "Walls - Curtain Wall Grids"; "Curtain Panels"; }
python_script = Python(IN[0]=string_from_object, IN[1]=code_block_2.out0, IN[2]=code_block_2.out1, IN[3]=code_block_2.out2)  # IronPython2
# ---------- python_script.python (20 lines) ----------
# Load the Python Standard and DesignScript Libraries
import sys
import clr
clr.AddReference('ProtoGeometry')
from Autodesk.DesignScript.Geometry import *

# The inputs to this node will be stored as a list in the IN variables.
elem = IN[0]
no1 = IN[1]
no2 = IN[2]
no3 = IN[3]

OUT=[]

# Place your code below this line
for i in xrange (len(elem)):
	if elem[i] == no1 or elem[i] == no2 or elem[i] == no3:
		OUT.append(False)
	else:
		OUT.append(True)
# ----------------------------------------
filterByBoolMask = List.FilterByBoolMask(list=flatten, mask=python_script)
code_block_3 = CodeBlock { "Area"; }
getParameterValueByName = Element.GetParameterValueByName(element=filterByBoolMask.in, parameterName=code_block_3)
code_block_4 = CodeBlock { ""; }
eq = getParameterValueByName == code_block_4
filterByBoolMask_2 = List.FilterByBoolMask(list=filterByBoolMask.in, mask=eq)
elementType = Element.ElementType(element=filterByBoolMask_2.out)
uniqueItems = List.UniqueItems(list=elementType)

# group: Split CB components
code_block_5 = CodeBlock { "CB component ID"; }
getParameterValueByName_2 = Element.GetParameterValueByName(element=uniqueItems, parameterName=code_block_5)
code_block_6 = CodeBlock { ""; }
eq_2 = getParameterValueByName_2 == code_block_6
filterByBoolMask_3 = List.FilterByBoolMask(list=uniqueItems, mask=eq_2)

# group: Find original component
code_block_7 = CodeBlock { "Original Revit component ID"; }
parameterByName = Parameter.ParameterByName(element=filterByBoolMask_3.out, name=code_block_7)
value = Parameter.Value(parameter=parameterByName)
element_from_id = Python(IN[0]=value)  # IronPython2; unwired: IN[1]
# ---------- element_from_id.python (30 lines) ----------
import clr
clr.AddReference('RevitAPI')
from Autodesk.Revit.DB import *

clr.AddReference("RevitNodes")
import Revit
clr.ImportExtensions(Revit.Elements)

clr.AddReference("RevitServices")
import RevitServices
from RevitServices.Persistence import DocumentManager

def ElementById(item, doc):
	try: 
		return doc.GetElement(item).ToDSType(True)
	except:
		try:
			return doc.GetElement(ElementId(item)).ToDSType(True)
		except:
			return None

items = UnwrapElement(IN[0])
inputdoc = UnwrapElement(IN[1])
if not inputdoc: doc = DocumentManager.Instance.CurrentDBDocument
elif inputdoc.GetType().ToString() == "Autodesk.Revit.DB.RevitLinkInstance": doc = inputdoc.GetLinkDocument()
elif inputdoc.GetType().ToString() == "Autodesk.Revit.DB.Document": doc = inputdoc
else: doc = DocumentManager.Instance.CurrentDBDocument

if isinstance(IN[0], list): OUT = [ElementById(x, doc) for x in items]
else: OUT = ElementById(items, doc)
# ----------------------------------------

join = List.Join(list0=filterByBoolMask_3.in, list1=element_from_id)
join_2 = List.Join(list0=join, list1=filterByBoolMask_3.out)
code_block_8 = CodeBlock { "Global Warming Potential"; }
code_block_9 = CodeBlock { "Construction Weight [kg/m2]"; }

# group: Check if the parameters already exist
parameters = Element.Parameters(element=uniqueItems)

name = Parameter.Name(parameter=parameters)

# group (continued): Check if the parameters already exist
python_script_2 = Python(IN[0]=name, IN[1]=code_block_8, IN[2]=code_block_9)  # IronPython2
# ---------- python_script_2.python (19 lines) ----------
import clr
clr.AddReference('ProtoGeometry')
from Autodesk.DesignScript.Geometry import *
#The inputs to this node will be stored as a list in the IN variables.
elementParameters=IN[0]
parameter=IN[1]
parameter1=IN[2]
x=[]

for i in xrange (len(elementParameters)):
	if parameter in elementParameters[i]:
		x.Add(1)
	else:
		x.Add(0)

if max(x)==1:
	OUT=None
else:
	OUT=[parameter,parameter1]
# ----------------------------------------

# group: Create instance parameters
string = StringInput("Circle Bank")
select_parameter_type = ParameterType("Number")
select_builtin_parameter_group = BuiltInParameterGroup("PG_GREEN_BUILDING")
boolean = BoolSelector(false)
createProjectParameter = Parameter.CreateProjectParameter(parameterName=python_script_2, groupName=string, type=select_parameter_type, group=select_builtin_parameter_group, instance=boolean, categoryList=byName)

file_path = Filename("..\..\Box\HD Lab\02 Projekter\0137 Circle Bank [Innovation Foundation]\05 Databases\LCA\05 LCA for Revit Extension\RevitExtensionLCAData20-04-2022-normalized.xlsx")
file_from_path = FileObject(path=file_path)
code_block_10 = CodeBlock { "Results for Lorenzo"; }
boolean_2 = BoolSelector(false)
importExcel = Data.ImportExcel(file=file_from_path, sheetName=code_block_10, showExcel=boolean_2)
python_script_3 = Python(IN[0]=importExcel)  # IronPython2
# ---------- python_script_3.python (15 lines) ----------
# Load the Python Standard and DesignScript Libraries
import sys
import clr
clr.AddReference('ProtoGeometry')
from Autodesk.DesignScript.Geometry import *

# The inputs to this node will be stored as a list in the IN variables.
lca = IN[0]

OUT=[]

# Place your code below this line
for i in xrange(len(lca)):
	if lca[i][0] == "Bygningsdel":
		OUT.append(i)
# ----------------------------------------
getItemAtIndex = List.GetItemAtIndex(list=importExcel, index=python_script_3)
code_block_11 = CodeBlock { 1; }
getItemAtIndex_2 = List.GetItemAtIndex(list=getItemAtIndex@L2, index=code_block_11)
getCategory_2 = Element.GetCategory(element=join)
string_from_object_2 = FromObject(object=getCategory_2)
python_script_4 = Python(IN[0]=string_from_object_2)  # IronPython2
# ---------- python_script_4.python (24 lines) ----------
# Load the Python Standard and DesignScript Libraries
import sys
import clr
clr.AddReference('ProtoGeometry')
from Autodesk.DesignScript.Geometry import *

# The inputs to this node will be stored as a list in the IN variables.
categ = IN[0]

OUT = []

# Place your code below this line

for i in xrange(len(categ)):
	if categ[i] == "Walls":
		OUT.append("Ydervæg 1")
	elif categ[i] == "Floors":
		OUT.append("Etagedæk 1")
	elif categ[i] == "Windows":
		OUT.append("Vindue1")
	elif categ[i] == "Doors":
		OUT.append("Dør 1")
	elif categ[i] == "Roofs":
		OUT.append("Terrændek 3")
# ----------------------------------------
indexOf = List.IndexOf(list=getItemAtIndex_2, element=python_script_4)
getItemAtIndex_3 = List.GetItemAtIndex(list=getItemAtIndex, index=indexOf)
code_block_12 = CodeBlock { 4; 14; }
getItemAtIndex_4 = List.GetItemAtIndex(list=getItemAtIndex_3@L2, index=code_block_12.out1)

# group: Reading JSON
readDatabase = HDLab_ZeroTouch.CircleBank.ReadDatabase()
parseJSON = Data.ParseJSON(json=readDatabase)
code_block_13 = CodeBlock { "materialtypes"; }
valueAtKey = DesignScript.Builtin.Dictionary.ValueAtKey(dictionary=parseJSON, key=code_block_13)
values = DesignScript.Builtin.Dictionary.Values(dictionary=valueAtKey)

# group: Find correspondent components on CB database
code_block_14 = CodeBlock { "materialid"; }
valueAtKey_2 = DesignScript.Builtin.Dictionary.ValueAtKey(dictionary=values, key=code_block_14)
code_block_15 = CodeBlock { "CB component ID"; }
parameterByName_2 = Parameter.ParameterByName(element=filterByBoolMask_3.out, name=code_block_15)
value_2 = Parameter.Value(parameter=parameterByName_2)
indexOf_2 = List.IndexOf(list=valueAtKey_2, element=value_2)
getItemAtIndex_5 = List.GetItemAtIndex(list=values, index=indexOf_2)

# note: Artefizio. Weight is not yet present in CB database
code_block_16 = CodeBlock { "width"; }
valueAtKey_3 = DesignScript.Builtin.Dictionary.ValueAtKey(dictionary=getItemAtIndex_5, key=code_block_16)
join_3 = List.Join(list0=getItemAtIndex_4, list1=valueAtKey_3)
getItemAtIndex_6 = List.GetItemAtIndex(list=getItemAtIndex_3@L2, index=code_block_12.out0)
code_block_17 = CodeBlock { "gwpreused"; }
valueAtKey_4 = DesignScript.Builtin.Dictionary.ValueAtKey(dictionary=getItemAtIndex_5, key=code_block_17)
join_4 = List.Join(list0=getItemAtIndex_6, list1=valueAtKey_4)

# group: Set parameters value
passthrough = Custom[Passthrough](passThrough=join_2, waitFor=createProjectParameter)  # package Clockwork for Dynamo 2.x; Forces a sequential order of execution. The node wired into the output of the Passthrough node will be executed *after* the node wired into the waitFor input (e.g. important for some Revit operations). The value of the passThrough input will be passed on to the node wired into the output port of the Passthrough node.
setParameterByName = Element.SetParameterByName(element=passthrough, parameterName=code_block_9, value=join_3)
setParameterByName_2 = Element.SetParameterByName(element=passthrough, parameterName=code_block_8, value=join_4)

# group: UI Report
code_block_18 = CodeBlock { "Global Warming Potential values have been estimated and assigned to the project components."; }
python_script_5 = Python(IN[0]=code_block_18, IN[1]=setParameterByName_2)  # IronPython2
# ---------- python_script_5.python (15 lines) ----------
# Load the Python Standard and DesignScript Libraries
import sys
import clr
clr.AddReference('ProtoGeometry')
from Autodesk.DesignScript.Geometry import *

# The inputs to this node will be stored as a list in the IN variables.
run = IN[0]
test = IN[1]

# Place your code below this line
if len(test) != 0:
	OUT = run
else:
	OUT = 0
# ----------------------------------------
UI_Report = HDLab_ZeroTouch.CircleBank.UI_Report(text=python_script_5)
