# Dynamo graph script.dyn "LCAviewType" (Dynamo 2.12.0.5650)
# packages: Genius Loci 2022.1.5

current = Document.Current()
activeView = Document.ActiveView(document=current)
all_elements_in_active_view = ElementsInView()
get_elements_overrides = Custom[Get Elements Overrides](view=activeView, element=all_elements_in_active_view)  # package Genius Loci; Get the overrides applied to the elements in the given View. Note : Prior to Revit 2019, the materials have only one surface pattern and one cut pattern.
python_script = Python(IN[0]=get_elements_overrides.SurfaceForegroundPatternColor)  # IronPython2
# ---------- python_script.python (14 lines) ----------
# Load the Python Standard and DesignScript Libraries
import sys
import clr
clr.AddReference('ProtoGeometry')
from Autodesk.DesignScript.Geometry import *

# The inputs to this node will be stored as a list in the IN variables.
overrides = IN[0]

# Place your code below this line
if overrides[0] == None:
	OUT = False
else:
	OUT = True
# ----------------------------------------
python_script_2 = Python(IN[0]=python_script, IN[1]=all_elements_in_active_view)  # IronPython2
# ---------- python_script_2.python (15 lines) ----------
# Load the Python Standard and DesignScript Libraries
import sys
import clr
clr.AddReference('ProtoGeometry')
from Autodesk.DesignScript.Geometry import *

# The inputs to this node will be stored as a list in the IN variables.
bool = IN[0]
elements = IN[1]

# Place your code below this line
if bool == False:
	OUT = [elements, None]
else:
	OUT = [None, elements]
# ----------------------------------------
lastItem = List.LastItem(list=python_script_2)
view_resetelementoverrides = Custom[View ResetElementOverrides](view=activeView, element=lastItem)  # package Genius Loci; Removes all Graphics overrides for an element in a given view.
firstItem = List.FirstItem(list=python_script_2)
fill_patterns = FillPatterns("<Solid fill>")
color_palette = ColorPalette({R: 173, G: 255, B: 47, A: 255})
color_palette_2 = ColorPalette({R: 255, G: 255, B: 0, A: 255})
color_palette_3 = ColorPalette({R: 255, G: 0, B: 0, A: 255})
list_create = List.Create(item0=color_palette, item1=color_palette_2, item2=color_palette_3)
code_block = CodeBlock { 0; 0.5; 1; }
list_create_2 = List.Create(item0=code_block.out0, item1=code_block.out1, item2=code_block.out2)
elementType = Element.ElementType(element=all_elements_in_active_view)
code_block_2 = CodeBlock { "Global Warming Potential"; }
parameterByName = Parameter.ParameterByName(element=elementType, name=code_block_2)
value = Parameter.Value(parameter=parameterByName)
minimumItem = List.MinimumItem(list=value)
maximumItem = List.MaximumItem(list=value)
code_block_3 = CodeBlock { 0; 1; }
mapTo = Math.MapTo(rangeMin=minimumItem, rangeMax=maximumItem, inputValue=value, targetRangeMin=code_block_3.out0, targetRangeMax=code_block_3.out1)
color_range = ColorRange(colors=list_create, indices=list_create_2, value=mapTo)
code_block_4 = CodeBlock { 50; }
create_overridegraphicsettings = Custom[Create OverrideGraphicSettings](SurfaceForegroundPattern=fill_patterns, SurfaceForegroundPatternColor=color_range, SurfaceBackgroundPattern=fill_patterns, SurfaceBackgroundColor=color_range, Transparency=code_block_4)  # package Genius Loci; Create a OverrideGraphicSettings (All graphic inputs are optional). Unlike the OOTB OverrideGraphicSettings.ByProperties node, the Foreground and background patterns are available. Note : Prior to Revit 2019, the materials have only one surface pattern and one cut pattern.
view_setelementoverrides = Custom[View SetElementOverrides](view=activeView, elements=firstItem, overrides=create_overridegraphicsettings)  # package Genius Loci; Overrides element graphics settings in the given view. For use with the Create OverrideGraphicSettings node. Can also be used to hide or unhide elements.
